# Grasshopper definition simple_one.gh (Grasshopper 1.0.7)

cell_count = Slider(50, range=10..50)
box_z = Slider(10, range=5..10)

# ---- group: RH_IN:radius
box_x = Slider(10, range=5..10)

# ---- group: RH_IN:count
box_y = Slider(5, range=5..10)

# ---- group: RH_IN:explode
number_slider = Slider(1, range=0..5)

# ----
center_box = CenterBox(Base=PlaneXY(0, 0, 0), X=box_x, Y=box_y, Z=box_z)
populate_3d = Populate3D(Region=center_box, Count=cell_count, Seed=1)
area = Area(Geometry=center_box)  # -> Area, Centroid
voronoi_3d = Voronoi3D(Points=populate_3d)  # -> flatten(Cells), Boundary
point = Point(populate_3d)
vector_2pt = Vector2Pt(PointA=area.Centroid, PointB=point, Unitize=False)  # -> Vector, Length
multiplication = Multiplication(A=vector_2pt.Vector, B=number_slider)
move = Move(Geometry=voronoi_3d.Cells, Motion=multiplication)  # -> Geometry, Transform

# ---- group: RH_OUT:mesh
mesh = Mesh(move.Geometry)

# ----
custom_preview = CustomPreview(Geometry=mesh, Material=ColourSwatch(SwatchColor=RGB(255, 64, 64)))
