# Grasshopper definition rnd_node.gh (Grasshopper 1.0.7)

# ---- group: RH_IN:y
box_y = Slider(10, range=5..10)

# ---- group: RH_IN:x
box_x = Slider(5, range=5..10)

# ----
addition = Addition(A=box_x, B=box_y)
center_box = CenterBox(Base=PlaneXY(0, 0, 0), X=addition, Y=box_x, Z=box_y)
settings_custom = SettingsCustom(
    StitchSeams=invert(True),
    SimplePlanes=invert(True),
    Refine=True,
    MinCount=Slider(40, range=0..40),
    MaxCount=400,
    AspectRatio=20,
    MaxDistance=0,
    MaxAngle=20,
    MinEdge=0,
    MaxEdge=0)
mesh_brep = MeshBrep(Brep=center_box, Settings=settings_custom)
mesh_edges = MeshEdges(Mesh=mesh_brep)  # -> NakedEdges, InteriorEdges, NonManifoldEdges
range = Range(Domain=Domain(0, 1), Steps=Slider(13, range=1..40))
gradient = Gradient(LowerLimit=0, UpperLimit=1, Parameter=range, stops=[0: RGB(215, 30, 210), 0.8: RGB(0, 192, 192), 1: RGB(255, 130, 160)])
dash_pattern = DashPattern(Curve=mesh_edges.InteriorEdges, Pattern=Slider(0.3, range=0.1..2))  # -> Dashes, Gaps
mesh_colours = MeshColours(Mesh=mesh_brep, Colours=gradient)

# ---- group: RH_OUT:edges
curve = Curve(flatten([mesh_edges.NakedEdges, dash_pattern.Dashes]))

# ---- group: RH_OUT:mesh
mesh = Mesh(mesh_colours)
