# Grasshopper definition delaunay_test.gh (Grasshopper 1.0.7)

# ---- group: RH_IN:points
pt = Point()

# ----
mesh_sphere = MeshSphere(Base=pt, Radius=Slider(0.01, range=0.001..0.01), UCount=10, VCount=20)
del = DelaunayMesh(Points=pt, Plane=PlaneXY(0, 0, 0))

# ---- group: RH_OUT:mesh
mesh = Mesh([del, mesh_sphere])
