# Grasshopper definition kangaroo.gh (Grasshopper 1.0.7)
# plug-ins: Kangaroo2 Components, NGon, OpenNest

legend = Slider(22, range=0..25)
seed = Slider(17, range=1..30)
surface = Surface(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)
unit_z = UnitZ(Factor=Slider(23, range=1..50))
seed_2 = GetNumber(seed, AtLeast=1, AtMost=2147483647, Maximum=1.797693135e+308, Minimum=-1.797693135e+308)
length = GetNumber(Slider(0, range=0..1), AtLeast=1, AtMost=2147483647, Maximum=1.797693135e+308, Minimum=-1.797693135e+308)
strength = GetNumber(Slider(30, range=1..30), AtLeast=1, AtMost=2147483647, Maximum=1.797693135e+308, Minimum=-1.797693135e+308)
iterations = GetNumber(Slider(921, range=0..1000), AtLeast=1, AtMost=2147483647, Maximum=1.797693135e+308, Minimum=-1.797693135e+308)
legend_2 = GetNumber(legend, AtLeast=1, AtMost=2147483647, Maximum=1.797693135e+308, Minimum=-1.797693135e+308)
unit_z_2 = UnitZ(Factor=Slider(17, range=1..100))
extrude = Extrude(Base=surface, Direction=unit_z_2)
move = Move(Geometry=extrude, Motion=unit_z)  # -> Geometry, Transform
number_slider = Slider(20, range=0..100)
number_slider_2 = Slider(2.8, range=0..10)
populate_3d = Populate3D(Region=move.Geometry, Count=100, Seed=seed_2)
area = Area(Geometry=surface)  # -> Area, Centroid
mesh_surface = MeshSurface(Surface=surface, UCount=number_slider, VCount=number_slider, Overhang=True, Equalize=False)
point = Point([Point(-11.26745289, 7.464670571, 0), Point(1.582547305, 9.528145827, 0), Point(3.724214003, -9.043131476, 0)])
closest_point = ClosestPoint(Point=graft(point), Cloud=populate_3d)  # -> flatten(ClosestPoint), CPIndex, Distance
deconstruct_brep = DeconstructBrep(Brep=surface)  # -> Faces, Edges, Vertices
scale_nu = ScaleNU(Geometry=surface, Plane=area.Centroid, ScaleX=number_slider_2, ScaleY=number_slider_2, ScaleZ=1)  # -> Geometry, Transform
vector_2pt = Vector2Pt(PointA=area.Centroid, PointB=closest_point.ClosestPoint, Unitize=False)  # -> Vector, Length
edgelengths = EdgeLengths(Mesh=mesh_surface, LengthFactor=length, Strength=strength)
anchor = Anchor(Point=deconstruct_brep.Vertices, Strength=10000)
vertexloads = VertexLoads(Mesh=mesh_surface, Strength=-0.1)
anchor_2 = Anchor(Point=point, Target=closest_point.ClosestPoint, Strength=10000)
show = Show(G=mesh_surface)
amplitude = Amplitude(Vector=vector_2pt.Vector, Amplitude=1)
line_sdl = LineSDL(
    Start=closest_point.ClosestPoint,
    Direction=amplitude,
    Length=[Slider(9, range=1..50), Slider(16, range=1..50), Slider(5, range=1..50)])
end_points = EndPoints(Curve=line_sdl)  # -> Start, End
zombiesolver = ZombieSolver(
    GoalObjects=flatten([show, edgelengths, anchor, vertexloads, anchor_2]),
    Threshold=1e-10,
    Tolerance=0.01,
    MaxIterations=iterations)  # -> I, V, O
list_item = ListItem(List=zombiesolver.O, Index=0, Wrap=True)  # -> Item, Item1

panel = Panel("http://climate.onebuilding.org/WMO_Region_4_North_and_Central_America/USA_United_States_of_America/WI_Wisconsin/USA_WI_Madison-Dane.County.Rgnl.AP-Truax.Field.726410_TMY3.zip")
downloadepw = LBDownloadWeather(weather_URL=panel)  # -> epw_file, stat_file, ddy_file; plug-in component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
importloc = LBImportLocation(epw_file=downloadepw.epw_file)  # -> location; plug-in component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

geometry = Geometry(zombiesolver.O)
mesh_edges = MeshEdges(Mesh=list_item.Item)  # -> NakedEdges, InteriorEdges, NonManifoldEdges
deconstruct_mesh = DeconstructMesh(Mesh=list_item.Item)  # -> Vertices, Faces, Colours, Normals

analysisperiod = LBAnalysisPeriod(start_month="6", start_day="21", start_hour=0, end_month="6", end_day="21", end_hour=23, timestep="1")  # -> period, hoys, dates; plug-in component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

list_length = ListLength(List=deconstruct_mesh.Faces)
dash_pattern = DashPattern(Curve=mesh_edges.InteriorEdges, Pattern=Slider(0.4, range=0.1..2))  # -> Dashes, Gaps
curve = Curve(mesh_edges.NakedEdges)
series = Series(Start=0, Step=1, Count=list_length)  # -> simplify(Series)
gradient = Gradient(LowerLimit=0, UpperLimit=list_length, Parameter=series, stops=[0: RGB(255, 130, 160), 1: RGB(0, 99, 177)])
colrange = LBColorRange(index=legend_2)  # -> colors; plug-in component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

sunpath = LBSunPath(north="20", location=importloc, hoys=analysisperiod.hoys, scale=1)  # -> report, vectors, altitudes, azimuths, hoys, sun_pts, analemma, daily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; plug-in component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

legendpar = LBLegendParameters(colors=colrange)  # -> leg_par; plug-in component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

# ---- group: Run Me!
toggle = BooleanToggle(True)

# ----
directsunhours = LBDirectSunHours(
    vectors=flatten(sunpath.vectors),
    timestep="1",
    geometry=flatten(scale_nu.Geometry),
    context=flatten(list_item.Item),
    grid_size="2",
    offset_dist="0.1",
    legend_par=legendpar,
    run=toggle)  # -> report, points, results, mesh, legend, title, int_mtx; plug-in component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

deconstruct_brep_2 = DeconstructBrep(Brep=scale_nu.Geometry)  # -> Faces, Edges, Vertices
mesh_colours = MeshColours(Mesh=list_item.Item, Colours=gradient)
unit_x = UnitX(Factor=Slider(16, range=1..100))
list_item_2 = ListItem(List=deconstruct_brep_2.Vertices, Index=Slider(1, range=0..4), Wrap=True)
list_item_3 = ListItem(List=directsunhours.legend, Index=0, Wrap=True)
panel_2 = Panel("""0
1""")
move_2 = Move(Geometry=list_item_2, Motion=unit_x)  # -> Geometry, Transform
cull_index = CullIndex(List=directsunhours.legend, Indices=panel_2, Wrap=True)
series_2 = Series(Start=Slider(2, range=1..20), Step=Slider(10.888, range=1..20), Count=Slider(11, range=0..100))
unit_y = UnitY(Factor=series_2)
list_length_2 = ListLength(List=cull_index)
move_3 = Move(Geometry=move_2.Geometry, Motion=unit_y)  # -> Geometry, Transform

# ---- group: RH_OUT:curveskangar
curve_2 = Curve([curve, dash_pattern.Dashes, line_sdl])

# ----
mesh = Mesh(list_item_3)

# ---- group: RH_OUT:mesh
mesh_2 = Mesh(directsunhours.mesh)

# ---- group: RH_OUT:ground
groundmesh = Mesh(mesh_colours)

# ----
number_slider_3 = Slider(3.3, range=0.1..20)
text = Text(Location=move_3.Geometry, Text=cull_index, Size=number_slider_3, Bold=False, HorizontalAlignment=0, VerticalAlignment=0)
text_2 = Text(Location=move_3.Geometry, Text=cull_index, Size=number_slider_3)
text_tag_3d = TextTag3D(Location=move_3.Geometry, Text=cull_index, Size=number_slider_3, Justification=7)
