# Grasshopper definition lunarc.gh (Grasshopper 1.0.7)
# plug-ins: Heteroptera, MeshEdit Components

crv = Curve(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)
brep = Brep(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)
pt = Point([Point(-2560.972738, -75.32748777, 0), Point(-2558.272738, -72.62748777, 0), Point(-2555.572738, -75.32748777, 0), Point(-2558.272738, -78.02748777, 0), Point(-2558.272738, -75.32748777, 1.5)])
# PART C  //  2 PERSON VERTICAL
# + PART DEFINITION
brep_2 = Brep(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)
crv_2 = Curve([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])

front_extrusion = Slider(1.55, range=0..3)
connection_face = Slider(0.45, range=0..5)
# PART B  //  2 PERSON
# + PART DEFINITION
X = Slider(3, range=0..8)
rotation = Slider(0, range=-45..45)

front_extrusion_2 = Slider(1.2, range=0..3)
connection_face_2 = Slider(0.45, range=0..5)
# + PART DEFINITION
X_2 = Slider(6, range=0..8)
rotation_2 = Slider(0, range=-45..45)

conndir = Wasp_ConnectionFromDirection(GEO=brep_2, CEN=pt, UP=crv_2, T="2PER_V-SID")  # -> CONN, PLN_OUT; inputs CEN: list of Point3d, UP: list of Curve, T: list; plug-in component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

crv_3 = Curve(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)
pt_2 = Point(Point(-2558.272738, -75.32748777, -2.7))
conndir_2 = Wasp_ConnectionFromDirection(GEO=brep_2, CEN=pt_2, UP=crv_3, T="2PER_V-FRO")  # -> CONN, PLN_OUT; inputs CEN: list of Point3d, UP: list of Curve, T: list; plug-in component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
# PART F  // COLUMN
toggle = BooleanToggle(True)
attribute = Wasp_Attribute(ID="LADYBUG", VAL=brep_2, TR=toggle)  # -> ATTR; inputs VAL: list, TR: Boolean; plug-in component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
advpart = Wasp_AdvancedPart(NAME="2PER_V", GEO=brep_2, CONN=flatten([conndir_2.CONN, conndir.CONN]), ATTR=flatten(attribute))  # -> PART; inputs GEO: Mesh, CONN: list, HI: list, ATTR: list, SUP: list, AEC: list, OC: list; plug-in component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

pt_3 = Point(Point(-2451.537057, -75.48048769, 4))
# + PART DEFINITION
part_j_geom = Geometry(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)
crv_4 = Curve(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)
brep_3 = Brep(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)
conndir_3 = Wasp_ConnectionFromDirection(GEO=part_j_geom, CEN=pt_3, UP=crv_4, T="COL-TOP")  # -> CONN, PLN_OUT; inputs CEN: list of Point3d, UP: list of Curve, T: list; plug-in component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
attribute_2 = Wasp_Attribute(ID="LADYBUG", VAL=brep_3, TR=Toggle(True))  # -> ATTR; inputs VAL: list, TR: Boolean; plug-in component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
advpart_2 = Wasp_AdvancedPart(NAME="COL", GEO=part_j_geom, CONN=flatten(conndir_3.CONN), ATTR=flatten(attribute_2))  # -> PART; inputs GEO: Mesh, CONN: list, HI: list, ATTR: list, SUP: list, AEC: list, OC: list; plug-in component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
preview = CustomPreview(
    Geometry=part_j_geom,
    Material={diffuse=RGB(221, 160, 221), emission=RGB(66, 48, 66), shine=0.5, specular=RGB(255, 255, 255), transparency=0})

brep_4 = Brep(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)
pt_4 = Point([Point(-2431.966297, -76.98006532, 14.10000024), Point(-2431.966297, -76.98006532, 9.900000174), Point(-2431.966297, -76.98006532, 5.700000105), Point(-2425.823823, -76.88051672, 14.10000024), Point(-2425.823823, -76.88206297, 9.900000174), Point(-2425.823823, -76.88206297, 5.700000105)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])
crv_5 = Curve([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])
brep_5 = Brep(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)
# PART G  // COMMUNAL
# + PART DEFINITION
part_h_geom = Geometry(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)
crv_6 = Curve([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])
pt_5 = Point([Point(-2431.96707, -74.70179702, 2.523478969), Point(-2425.824597, -73.37475192, 2.523478969), Point(-2430.006868, -67.15623884, 2.523478969)])
seed_reset = Slider(21, range=0..100)
month = Slider(1, range=1..12)
start_hour = Slider(1, range=1..23)
attribute_3 = Wasp_Attribute(ID="LADYBUG", VAL=brep_5, TR=Toggle(True))  # -> ATTR; inputs VAL: list, TR: Boolean; plug-in component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
end_hour = Slider(23, range=1..23)
day = Slider(1, range=1..30)
x_position = Slider(30, range=30..130)
y_position = Slider(30, range=30..190)
conndir_4 = Wasp_ConnectionFromDirection(GEO=part_h_geom, CEN=pt_4, UP=crv_6, T="COM-SID")  # -> CONN, PLN_OUT; inputs CEN: list of Point3d, UP: list of Curve, T: list; plug-in component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

# ---- group: Run Me!
toggle_2 = BooleanToggle(True)

# ----
conndir_5 = Wasp_ConnectionFromDirection(GEO=part_h_geom, CEN=pt_5, UP=crv_5, T="COM-BOT")  # -> CONN, PLN_OUT; inputs CEN: list of Point3d, UP: list of Curve, T: list; plug-in component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
x_position_2 = GetNumber(x_position, AtLeast=1, AtMost=2147483647, Maximum=1.797693135e+308, Minimum=-1.797693135e+308)
y_position_2 = GetNumber(y_position, AtLeast=1, AtMost=2147483647, Maximum=1.797693135e+308, Minimum=-1.797693135e+308)
collider = Wasp_Collider(GEO=brep_4)  # -> COLL; inputs GEO: list of Mesh, MUL: Boolean, ALL: Boolean, CONN: list; plug-in component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
advpart_3 = Wasp_AdvancedPart(NAME="COM", GEO=part_h_geom, CONN=flatten([conndir_4.CONN, conndir_5.CONN]), COLL=collider, ATTR=flatten(attribute_3))  # -> PART; inputs GEO: Mesh, CONN: list, HI: list, ATTR: list, SUP: list, AEC: list, OC: list; plug-in component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

# ----
# COMMUNAL PARTS
# PART C  //  NOD
# + PART DEFINITION
part_h_geom_2 = Geometry(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)
pt_6 = Point(Point(-2500.655065, -42.14469244, 2.85))
crv_7 = Curve(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)
crv_8 = Curve(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)
pt_7 = Point(Point(-2500.655065, -42.14469244, 1.8))
conndir_6 = Wasp_ConnectionFromDirection(GEO=part_h_geom_2, CEN=pt_6, UP=crv_7, T="NOD-TOP")  # -> CONN, PLN_OUT; inputs CEN: list of Point3d, UP: list of Curve, T: list; plug-in component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
conndir_7 = Wasp_ConnectionFromDirection(GEO=part_h_geom_2, CEN=pt_7, UP=crv_8, T="NOD-BOT")  # -> CONN, PLN_OUT; inputs CEN: list of Point3d, UP: list of Curve, T: list; plug-in component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
attribute_4 = Wasp_Attribute(ID="LADYBUG", VAL=part_h_geom_2, TR=Toggle(True))  # -> ATTR; inputs VAL: list, TR: Boolean; plug-in component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
part = Wasp_BasicPart(NAME="NOD", GEO=part_h_geom_2, CONN=flatten([conndir_6.CONN, conndir_7.CONN]), ATTR=flatten(attribute_4))  # -> PART; inputs GEO: Mesh, CONN: list, ATTR: list; plug-in component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

# ----
# PART D  // V CONNECTOR
# + PART DEFINITION
pt_8 = Point(Point(-2466.09255, -75.73048769, 0))
connection_size = Panel("2.1")
cluster = Cluster_8(point=pt_8, X=connection_size, Y=connection_size, Z=Slider(14.4, range=0..100))  # -> brep_2, bots_p, bots_c, tops_p, tops_c, bot_p, bot_c, top_p, top_c
part_h_geom_3 = Geometry(cluster.brep_2)
attribute_5 = Wasp_Attribute(ID="LADYBUG", VAL=part_h_geom_3, TR=Toggle(True))  # -> ATTR; inputs VAL: list, TR: Boolean; plug-in component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
crv_9 = Curve(cluster.top_c)
pt_9 = Point(cluster.top_p)
crv_10 = Curve(cluster.bot_c)
crv_11 = Curve(cluster.tops_c)
pt_10 = Point(cluster.bot_p)
pt_11 = Point(cluster.tops_p)
pt_12 = Point(cluster.bots_p)
crv_12 = Curve(cluster.bots_c)
conndir_8 = Wasp_ConnectionFromDirection(GEO=part_h_geom_3, CEN=pt_9, UP=crv_9, T="VCON-TOP")  # -> CONN, PLN_OUT; inputs CEN: list of Point3d, UP: list of Curve, T: list; plug-in component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
conndir_9 = Wasp_ConnectionFromDirection(GEO=part_h_geom_3, CEN=pt_10, UP=crv_10, T="VCON-BOT")  # -> CONN, PLN_OUT; inputs CEN: list of Point3d, UP: list of Curve, T: list; plug-in component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
conndir_10 = Wasp_ConnectionFromDirection(GEO=part_h_geom_3, CEN=pt_11, UP=crv_11, T="VCON-SID")  # -> CONN, PLN_OUT; inputs CEN: list of Point3d, UP: list of Curve, T: list; plug-in component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
conndir_11 = Wasp_ConnectionFromDirection(GEO=part_h_geom_3, CEN=pt_12, UP=crv_12, T="VCON-PER")  # -> CONN, PLN_OUT; inputs CEN: list of Point3d, UP: list of Curve, T: list; plug-in component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
advpart_4 = Wasp_AdvancedPart(
    NAME="VCON",
    GEO=part_h_geom_3,
    CONN=flatten([conndir_8.CONN, conndir_9.CONN, conndir_10.CONN, conndir_11.CONN]),
    ATTR=flatten(attribute_5))  # -> PART; inputs GEO: Mesh, CONN: list, HI: list, ATTR: list, SUP: list, AEC: list, OC: list; plug-in component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

length_a = Slider(9, range=0..12)
# PART E  // H CONNECTOR
# + PART DEFINITION
pt_13 = Point(Point(-2482.014756, -75.73048769, 0))
cluster_2 = Cluster_7(X=length_a, point=pt_13, Y=connection_size, Z=connection_size)  # -> st2_p, st2_c, brep_2, bot_p, bot_c, side_p, side_c, top_p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
number_slider = Slider(2, range=0..2)
part_j_geom_2 = Geometry(cluster_2.brep_2)
attribute_6 = Wasp_Attribute(ID="LADYBUG", VAL=part_j_geom_2, TR=Toggle(True))  # -> ATTR; inputs VAL: list, TR: Boolean; plug-in component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
mesh = Mesh(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)
unit_z = UnitZ(Factor=1)
pt_14 = Point(cluster_2.top_p)
pt_15 = Point(cluster_2.bot_p)
pt_16 = Point(cluster_2.side_p)
crv_13 = Curve(cluster_2.front_c)
crv_14 = Curve(cluster_2.top_c)
crv_15 = Curve(cluster_2.bot_c)
crv_16 = Curve(cluster_2.side_c)
pt_17 = Point(cluster_2.front_p)
construct_point = ConstructPoint(XCoordinate=x_position_2, YCoordinate=y_position_2, ZCoordinate=0)
contour = Contour(Shape=mesh, Point=Point(0, 0, 0), Direction=unit_z, Distance=Slider(0.984, range=0.1..4))  # -> flatten(Contours)
cull_i = CullIndex(List=pt_14, Indices=number_slider, Wrap=True)
cull_i_2 = CullIndex(List=crv_14, Indices=number_slider, Wrap=True)
item = ListItem(List=pt_14, Index=number_slider, Wrap=True)
item_2 = ListItem(List=crv_14, Index=number_slider, Wrap=True)
conndir_12 = Wasp_ConnectionFromDirection(GEO=part_j_geom_2, CEN=item, UP=item_2, T="HCON-ST")  # -> CONN, PLN_OUT; inputs CEN: list of Point3d, UP: list of Curve, T: list; plug-in component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
conndir_13 = Wasp_ConnectionFromDirection(GEO=part_j_geom_2, CEN=pt_16, UP=crv_16, T="HCON-SID")  # -> CONN, PLN_OUT; inputs CEN: list of Point3d, UP: list of Curve, T: list; plug-in component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
conndir_14 = Wasp_ConnectionFromDirection(GEO=part_j_geom_2, CEN=pt_17, UP=crv_13, T="HCON-FRO")  # -> CONN, PLN_OUT; inputs CEN: list of Point3d, UP: list of Curve, T: list; plug-in component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
conndir_15 = Wasp_ConnectionFromDirection(GEO=part_j_geom_2, CEN=cull_i, UP=cull_i_2, T="HCON-TOP")  # -> CONN, PLN_OUT; inputs CEN: list of Point3d, UP: list of Curve, T: list; plug-in component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
conndir_16 = Wasp_ConnectionFromDirection(GEO=part_j_geom_2, CEN=pt_15, UP=crv_15, T="HCON-BOT")  # -> CONN, PLN_OUT; inputs CEN: list of Point3d, UP: list of Curve, T: list; plug-in component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
fillet = Fillet(Curve=contour, Radius=Slider(12.8, range=0.1..20))
curve = Curve(fillet)
advpart_5 = Wasp_AdvancedPart(
    NAME="HCON",
    GEO=part_j_geom_2,
    CONN=flatten([conndir_15.CONN, conndir_16.CONN, conndir_13.CONN, conndir_14.CONN, conndir_12.CONN]),
    ATTR=flatten(attribute_6))  # -> PART; inputs GEO: Mesh, CONN: list, HI: list, ATTR: list, SUP: list, AEC: list, OC: list; plug-in component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
panel = Panel("""TRUE
FALSE
FALSE""")
cull_pattern = CullPattern(List=curve, CullPattern=invert(panel))
cull_pattern_2 = CullPattern(List=curve, CullPattern=panel)
dash_pattern = DashPattern(Curve=cull_pattern_2, Pattern=Slider(1.9, range=0.1..5))  # -> Dashes, Gaps
curve_2 = Curve(cull_pattern)

panel_2 = Panel("http://climate.onebuilding.org/WMO_Region_4_North_and_Central_America/USA_United_States_of_America/WI_Wisconsin/USA_WI_Madison-Dane.County.Rgnl.AP-Truax.Field.726410_TMY3.zip")
downloadepw = LBDownloadWeather(weather_URL=panel_2)  # -> epw_file, stat_file, ddy_file; plug-in component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
importloc = LBImportLocation(epw_file=downloadepw.epw_file)  # -> location; plug-in component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

mesh_weldvertices = MeshWeldVertices(Mesh=mesh, Tolerance=0.01)  # -> RuntimeMessage, Mesh
quad_remesh = QuadRemesh(Mesh=mesh, Settings={aqc=True, as=50, dhe=True, gci=0, null=False, pme=0, sa=0, tqc=2000})
analysisperiod = LBAnalysisPeriod(start_month=month, start_day=day, start_hour=start_hour, end_month=month, end_day=day, end_hour=end_hour)  # -> period, hoys, dates; plug-in component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
colrange = LBColorRange(index=Slider(11, range=0..25))  # -> colors; plug-in component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
mesh_edges = MeshEdges(Mesh=mesh_weldvertices.Mesh)  # -> NakedEdges, InteriorEdges, NonManifoldEdges
legendpar = LBLegendParameters(colors=colrange)  # -> leg_par; plug-in component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
mcomp = Decompose(Mesh=quad_remesh)  # -> Vertices, Faces, Colours, Normals
join_curves = JoinCurves(Curves=mesh_edges.NakedEdges, Preserve=False)
pcomp = Decompose(Point=mcomp.Vertices)  # -> XComponent, YComponent, ZComponent
bnd = Bounds(Numbers=pcomp.ZComponent)
divide_curve = DivideCurve(Curve=join_curves, Count=Slider(358, range=1..400), Kinks=False)  # -> Points, Tangents, Parameters
remap = RemapNumbers(Value=pcomp.ZComponent, Source=bnd, Target=Domain(0, 1))  # -> Mapped, Clipped
unit_z_2 = UnitZ(Factor=Slider(6, range=1..30))
polyline = PolyLine(Vertices=divide_curve.Points, Closed=True)
gradient = Gradient(
    LowerLimit=Slider(0, range=0..50),
    UpperLimit=Slider(50, range=0..50),
    Parameter=pcomp.ZComponent,
    stops=[0: RGB(255, 192, 203), 0.577: RGB(255, 255, 255)])
negative = Negative(Value=unit_z_2)
curve_3 = Curve(polyline)
number_slider_2 = Slider(51, range=1..100)
extrude = Extrude(Base=curve_3, Direction=negative)
mesh_brep = MeshBrep(
    Brep=extrude,
    Settings={GridMaxCount=0, GridMinCount=16, JaggedSeams=False, MaxEdgeLength=0, MinEdgeLength=0.0001, MinTolerance=0, Refine=True, RefineAngle=0, RelativeTolerance=0.65, SimplePlanes=True, Tolerance=0})
remap_2 = Remap(min=0, max=1)
panel_3 = Panel(remap_2)
mesh_2 = Mesh(Vertices=mcomp.Vertices, Faces=mcomp.Faces, Colours=gradient)
mesh_colours = MeshColours(Mesh=mesh_brep, Colours=ColourSwatch(SwatchColor=RGB(153, 153, 153)))

# ---- group: RH_OUT:curve
curve_4 = Curve([dash_pattern.Dashes, curve_2])

# ----
connection_rule = Panel("""NOD-TOP>COM-BOT
COM-SID>HCON-FRO
NOD-TOP>VCON-BOT
VCON-SID>HCON-FRO
HCON-FRO>VCON-SID
HCON-SID>4PER-FRO
HCON-SID>2PER-FRO
HCON-FRO>HCON-FRO
HCON-TOP>2PER_V-FRO
HCON-FRO>4PER-FRO
4PER-SID>2PER-SID
HCON-BOT>COL-TOP
2PER-STR>ST-FRO
2PER-SID>2PER-FRO
2PER_V-SID>ST-FRO""")

pt_18 = Point(Point(-2519.787731, -75.73048769, 0))
side_extrusion = Slider(1.55, range=0..3)
top_extrusion = Slider(1.55, range=0..3)
side_top_scaling = Slider(1, range=0..2)
Y = Slider(3, range=0..8)
Z = Slider(3, range=0..8)
flip_connection = BooleanToggle(False)
cluster_3 = Cluster(
    point=pt_18,
    A=X,
    A_2=Y,
    A_3=Z,
    scale_x="1",
    scale_y=graft(["1", side_top_scaling]),
    scale_z="1",
    data=front_extrusion,
    data_2=connection_face,
    d1=rotation,
    gate=flip_connection)  # -> length_2, breps, vertices, center_v, line_4, result, result_2
item_3 = ListItem(List=cluster_3.center_v, Index=0, Wrap=True)  # -> Item, Item1, Item2
item_4 = ListItem(List=cluster_3.line_4, Index=0, Wrap=True)  # -> Item, Item1, Item2
data = Data(cluster_3.breps)
attribute_7 = Wasp_Attribute(ID="LADYBUG", VAL=data, TR=Toggle(True))  # -> ATTR; inputs VAL: list, TR: Boolean; plug-in component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
item_5 = ListItem(List=cluster_3.result, Index=0, Wrap=True)  # -> Item, Item1, Item2
item_6 = ListItem(List=cluster_3.result_2, Index=0, Wrap=True)  # -> Item, Item1, Item2
pt_19 = Point(item_3.Item)
pt_20 = Point(item_3.Item2)
crv_17 = Curve(item_4.Item1)
pt_21 = Point(item_3.Item1)
crv_18 = Curve(item_4.Item2)
conndir_17 = Wasp_ConnectionFromDirection(GEO=data, CEN=pt_20, UP=crv_18, T="2PER-TOP")  # -> CONN, PLN_OUT; inputs CEN: list of Point3d, UP: list of Curve, T: list; plug-in component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
conndir_18 = Wasp_ConnectionFromDirection(GEO=data, CEN=pt_21, UP=crv_17, T="2PER-SID")  # -> CONN, PLN_OUT; inputs CEN: list of Point3d, UP: list of Curve, T: list; plug-in component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
conndir_19 = Wasp_ConnectionFromDirection(GEO=data, CEN=pt_19, UP=crv, T="2PER-FRO")  # -> CONN, PLN_OUT; inputs CEN: list of Point3d, UP: list of Curve, T: list; plug-in component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

conndir_20 = Wasp_ConnectionFromDirection(GEO=data, CEN=item_5.Item, UP=item_6.Item, T="2PER-STR")  # -> CONN, PLN_OUT; inputs CEN: list of Point3d, UP: list of Curve, T: list; plug-in component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

advpart_6 = Wasp_AdvancedPart(
    NAME="2PER",
    GEO=data,
    CONN=flatten([conndir_17.CONN, conndir_19.CONN, conndir_18.CONN, conndir_20.CONN]),
    ATTR=flatten(attribute_7))  # -> PART; inputs GEO: Mesh, CONN: list, HI: list, ATTR: list, SUP: list, AEC: list, OC: list; plug-in component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

# ----
# LIVING PARTS
# PART A  //  4 PERSON
pt_22 = Point(Point(-2536.871078, -75.73048769, 0))
crv_19 = Curve(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)
side_extrusion_2 = Slider(1.2, range=0..3)
top_extrusion_2 = Slider(1.2, range=0..3)
side_top_scaling_2 = Slider(0.412, range=0..1)
Y_2 = Slider(3, range=0..8)
Z_2 = Slider(3, range=0..8)
flip_connection_2 = BooleanToggle(False)
cluster_4 = Cluster(
    point=pt_22,
    A=X_2,
    A_2=Y_2,
    A_3=Z_2,
    scale_x="1",
    scale_y=graft(["1", side_top_scaling_2]),
    scale_z="1",
    data=[front_extrusion_2, side_extrusion_2, top_extrusion_2],
    data_2=connection_face_2,
    d1=rotation_2,
    gate=flip_connection_2)  # -> length_2, breps, vertices, center_v, line_4, result, result_2
attribute_8 = Wasp_Attribute(ID="LADYBUG", VAL=brep, TR=Toggle(True))  # -> ATTR; inputs VAL: list, TR: Boolean; plug-in component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

# ---- group: Tapered Connections
item_7 = ListItem(List=cluster_4.center_v, Index=0, Wrap=True)  # -> Item, Item1, Item2
item_8 = ListItem(List=cluster_4.line_4, Index=0, Wrap=True)  # -> Item, Item1, Item2

# ----
crv_20 = Curve(item_8.Item1)
pt_23 = Point(item_7.Item)
pt_24 = Point(item_7.Item1)
pt_25 = Point(item_7.Item2)
crv_21 = Curve(item_8.Item2)
conndir_21 = Wasp_ConnectionFromDirection(GEO=brep, CEN=pt_23, UP=crv_19, T="4PER-FRO")  # -> CONN, PLN_OUT; inputs CEN: list of Point3d, UP: list of Curve, T: list; plug-in component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
conndir_22 = Wasp_ConnectionFromDirection(GEO=brep, CEN=pt_24, UP=crv_20, T="4PER-SID")  # -> CONN, PLN_OUT; inputs CEN: list of Point3d, UP: list of Curve, T: list; plug-in component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
conndir_23 = Wasp_ConnectionFromDirection(GEO=brep, CEN=pt_25, UP=crv_21, T="4PER-TOP")  # -> CONN, PLN_OUT; inputs CEN: list of Point3d, UP: list of Curve, T: list; plug-in component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
advpart_7 = Wasp_AdvancedPart(NAME="4PER", GEO=brep, CONN=flatten([conndir_23.CONN, conndir_21.CONN, conndir_22.CONN]), ATTR=flatten(attribute_8))  # -> PART; inputs GEO: Mesh, CONN: list, HI: list, ATTR: list, SUP: list, AEC: list, OC: list; plug-in component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

# ----
# PART E  // STRUCTURE
# + PART DEFINITION
part_h_geom_4 = Geometry(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)
crv_22 = Curve(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)
pt_26 = Point(Point(-2489.972742, -77.29473444, 0))
conndir_24 = Wasp_ConnectionFromDirection(GEO=part_h_geom_4, CEN=pt_26, UP=crv_22, T="ST-FRO")  # -> CONN, PLN_OUT; inputs CEN: list of Point3d, UP: list of Curve, T: list; plug-in component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

attribute_9 = Wasp_Attribute(ID="LADYBUG", VAL=part_h_geom_4, TR=Toggle(True))  # -> ATTR; inputs VAL: list, TR: Boolean; plug-in component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

advpart_8 = Wasp_AdvancedPart(NAME="ST", GEO=part_h_geom_4, CONN=flatten(conndir_24.CONN), ATTR=flatten(attribute_9))  # -> PART; inputs GEO: Mesh, CONN: list, HI: list, ATTR: list, SUP: list, AEC: list, OC: list; plug-in component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

parts = Entwine(
    Branch00=advpart_7,
    Branch01=advpart_6,
    Branch02=part,
    Branch03=advpart_4,
    Branch04=advpart_5,
    Branch05=advpart_2,
    Branch06=advpart_3,
    Branch07=advpart_8,
    Branch08=advpart,
    FlattenInputs=True)  # -> flatten(Result)
parts_2 = Data(parts)

# ----
# RULES
rulegen = Wasp_RulesGenerator(PART=parts_2, GR=connection_rule)  # -> flatten(R); inputs PART: list, SELF_P: Boolean, SELF_C: Boolean, TYP: Boolean, GR: list; plug-in component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

rules = Data(rulegen)

neigh_b = Point([Point(48.43855017, 109.7120357, 0), Point(102.5220059, 88.12602372, 0)])
mesh_3 = Mesh(mesh)
Z_3 = UnitZ(Factor=1)
project = ProjectPoint(Point=neigh_b, Direction=Z_3, Geometry=mesh_3)  # -> Point, Index
pt_27 = Point(flatten(project.Point))
lng = ListLength(List=flatten(pt_27))
Z_4 = UnitZ(Factor=Slider(4, range=1..30))
move = Move(Geometry=pt_27, Motion=Z_4)  # -> Geometry, Transform

negative_2 = Negative(Value=Z_3)

center = Point(construct_point)
Z_5 = UnitZ(Factor=1)
project_2 = ProjectPoint(Point=center, Direction=Z_5, Geometry=mesh_3)  # -> Point, Index
center_2 = Point(project_2.Point)
Z_6 = UnitZ(Factor="80")
series = Series(Start=0, Step="4.2", Count="60")
Z_7 = UnitZ(Factor=series)
neg = Negative(Value=Z_7)
Z_8 = UnitZ(Factor="3")
neg_2 = Negative(Value=Z_8)

sunpath = LBSunPath(north="20", location=importloc, hoys=analysisperiod.hoys, center_pt=center_2, scale=1)  # -> report, vectors, altitudes, azimuths, hoys, sun_pts, analemma, daily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; plug-in component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

repeat = RepeatData(Data=center_2, Length=lng)
ln = Line(StartPoint=move.Geometry, EndPoint=repeat)  # -> simplify(graft(Line))
flip = FlipCurve(Curve=ln)  # -> Curve, Flag
eval = EvaluateCurve(Curve=reparameterize(flip.Curve), Parameter=Slider(0.3, range=0..1))  # -> Point, Tangent, Angle

project_3 = Project(Geometry=flatten([center_2, eval.Point]), Plane=center_2)  # -> Geometry, Transform
move_2 = Move(Geometry=project_3.Geometry, Motion=Z_6)  # -> Geometry, Transform
move_3 = Move(Geometry=graft(move_2.Geometry), Motion=neg)  # -> Geometry, Transform
project_4 = ProjectPoint(Point=move_2.Geometry, Direction=negative_2, Geometry=mesh_3)  # -> Point, Index
cps = ClosestPoints(Point=graft(project_4.Point), Cloud=move_3.Geometry, Count="1")  # -> ClosestPoint, CPIndex, Distance
move_4 = Move(Geometry=cps.ClosestPoint, Motion=neg_2)  # -> simplify(Geometry), Transform

center_3 = Center(Geometry=part_h_geom_2, referenceAll=2)  # -> Center, Dimension
pt_28 = Point(move_4.Geometry)
orient = Orient(Geometry=part_h_geom_2, Source=center_3.Center, Target=pt_28)  # -> Geometry, Transform
Z_9 = UnitZ(Factor=1)
line = LineSDL(Start=graft(center_2), Direction=Z_9, Length=Slider(59.4, range=0..1000))
M = MarkerDimension(Line=line, Text=graft("// LUNARC 2024"), Size=Slider(3, range=1..30))

end_points = EndPoints(Curve=line)  # -> Start, End

# ----
# STARTING POINT
parttr = Wasp_TransformPart(PART=part, TR=orient.Transform)  # -> flatten(PART_OUT); plug-in component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

text_tag = TextTag(Location=end_points.End, Text="// LUNARC 2024")
stochasticaggregation = Wasp_StochasticAggregation(PART=flatten(parts_2), PREV=parttr, N=Slider(82, range=1..300), RULES=rules, MODE="3", RESET=seed_reset)  # -> AGGR, PART_OUT; inputs PART: list, PREV: list, N: Int32, RULES: list, SEED: Int32, MODE: Int32, GC: list, RESET: Boolean; plug-in component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
getattr = Wasp_GetAttributeByName(PART=stochasticaggregation.PART_OUT, ID="LADYBUG")  # -> VAL; plug-in component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

directsunhours = LBDirectSunHours(
    vectors=flatten(sunpath.vectors),
    geometry=flatten(getattr),
    context=flatten(mesh),
    grid_size=Slider(5, range=1..5),
    offset_dist="0.1",
    legend_par=legendpar,
    run=toggle_2)  # -> report, points, results, mesh, legend, title, int_mtx; plug-in component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

# ---- group: RH_OUT:mesh
mesh_4 = Mesh(directsunhours.mesh)

# ==== cluster Cluster
point = ClusterInput()
A = ClusterInput()
A_2 = ClusterInput()
A_3 = ClusterInput()
point_2 = Point(point)
d1 = ClusterInput()
gate = ClusterInput()
data = ClusterInput()
data_2 = ClusterInput()
multiplication = Multiplication(A=A, B=".5")
multiplication_2 = Multiplication(A=A_2, B=".5")
multiplication_3 = Multiplication(A=A_3, B=".5")
data_3 = Data(data)
data_4 = Data(data_2)
center_box = CenterBox(Base=point_2, X=multiplication, Y=multiplication_2, Z=multiplication_3)
deconstruct_brep = DeconstructBrep(Brep=center_box)  # -> Faces, Edges, Vertices
area = Area(Geometry=deconstruct_brep.Faces)  # -> Area, Centroid
panel = Panel("""1
2
5""")
cull_index = CullIndex(List=deconstruct_brep.Faces, Indices=panel, Wrap=True)
list_item = ListItem(List=deconstruct_brep.Faces, Index=panel, Wrap=True)
point_list = PointList(Points=area.Centroid, Size="1")
is_planar = IsPlanar(Surface=list_item, Interior=True)  # -> Planar, Plane
deconstruct_plane = DeconstructPlane(Plane=is_planar.Plane)  # -> Origin, XAxis, YAxis, ZAxis
curve = Curve(list_item)
amplitude = Amplitude(Vector=deconstruct_plane.ZAxis, Amplitude=data_3)
move = Move(Geometry=curve, Motion=amplitude)  # -> Geometry, Transform
list_item_2 = ListItem(List=move.Geometry, Index=0, Wrap=True)  # -> Item, Item1, Item2
list_item_3 = ListItem(List=is_planar.Plane, Index=0, Wrap=True)  # -> Item, Item1, Item2
negative = Negative(Value=d1)
point_3 = Point(list_item_3.Item)
point_4 = Point(list_item_3.Item1)
data_5 = Data(list_item_2.Item)
merge = Merge(Data1=d1, Data2=negative)
rotate = Rotate(Geometry=[list_item_2.Item, list_item_2.Item1], Angle=degrees(merge), Plane=[point_3, point_4])  # -> Geometry, Transform
merge_2 = Merge(Data1=rotate.Geometry, Data2=list_item_2.Item2)
planar = Planar(Curve=merge_2)  # -> Planar, Plane, Deviation
negative_2 = Negative(Value=data_4)
scale_x = ClusterInput()
scale_y = ClusterInput()
scale_z = ClusterInput()
offset_curve = OffsetCurve(Curve=merge_2, Plane=planar.Plane, Distance=negative_2, BothSides=False, Kinks=0, CapType=1)
planar_2 = Planar(Curve=offset_curve)  # -> Planar, Plane, Deviation
panel_2 = Panel(".5")
scale_nu = ScaleNU(Geometry=offset_curve, Plane=planar_2.Plane, ScaleX=scale_x, ScaleY=scale_y, ScaleZ=scale_z)  # -> Geometry, Transform
explode = Explode(Curve=scale_nu.Geometry, Recursive=True)  # -> Segments, Vertices
list_item_4 = ListItem(List=cull_index, Index=0, Wrap=True)  # -> Item, Item1
merge_3 = Merge(Data1=graft(curve), Data2=scale_nu.Geometry)
explode_2 = Explode(Curve=list_item_4.Item1, Recursive=True)  # -> Segments, Vertices
loft = Loft(Curves=merge_3, Options={Adjust=False, Closed=False, LoftEnds=0, LoftSimp=0, LoftType=0, Rebuild=10, Refit=0.01})
brep_edges = BrepEdges(Brep=loft)  # -> Naked, Interior, NonManifold
explode_3 = Explode(Curve=list_item_4.Item, Recursive=True)  # -> Segments, Vertices
length = Length(Curve=explode.Segments)  # -> flatten(Length)
polygon_center = PolygonCenter(Polyline=list_item_4.Item1)  # -> flatten(CenterV), CenterE, CenterA
polygon_center_2 = PolygonCenter(Polyline=list_item_4.Item)  # -> flatten(CenterV), CenterE, CenterA
list_item_5 = ListItem(List=explode_2.Segments, Index="1", Wrap=True)
join_curves = JoinCurves(Curves=brep_edges.Naked, Preserve=False)
list_item_6 = ListItem(List=explode_3.Segments, Index="1", Wrap=True)
list_item_7 = ListItem(List=length, Index=0, Wrap=True)
pull_point = PullPoint(Point=polygon_center.CenterV, Geometry=flatten(list_item_5), ClosestOnly=True)  # -> ClosestPoint, Distance
pull_point_2 = PullPoint(Point=polygon_center_2.CenterV, Geometry=flatten(list_item_6), ClosestOnly=True)  # -> ClosestPoint, Distance
list_item_8 = ListItem(List=join_curves, Index=0, Wrap=True)  # -> Item, Item1
length_2 = ClusterOutput(list_item_7)  # Length
boundary_surfaces = BoundarySurfaces(Edges=list_item_8.Item)
line = Line(StartPoint=polygon_center.CenterV, EndPoint=pull_point.ClosestPoint)
line_2 = Line(StartPoint=polygon_center_2.CenterV, EndPoint=pull_point_2.ClosestPoint)
merge_4 = Merge(Data1=flatten(cull_index), Data2=flatten(loft), Data3=flatten(boundary_surfaces))  # -> flatten(Result)
curve_2 = Curve(boundary_surfaces)
flip_curve = FlipCurve(Curve=curve_2)  # -> Curve, Flag
polygon_center_3 = PolygonCenter(Polyline=boundary_surfaces)  # -> flatten(CenterV), CenterE, CenterA
brep_join = BrepJoin(Breps=merge_4)  # -> Breps, Closed
merge_5 = Merge(Data1=polygon_center.CenterV, Data2=polygon_center_2.CenterV)
merge_6 = Merge(Data1=line, Data2=line_2)
stream_filter = StreamFilter(Gate=gate, Stream0=curve_2, Stream1=flip_curve.Curve)
pull_point_3 = PullPoint(Point=polygon_center_3.CenterV, Geometry=flatten(stream_filter), ClosestOnly=True)  # -> ClosestPoint, Distance
breps = ClusterOutput(brep_join.Breps)
deconstruct_brep_2 = DeconstructBrep(Brep=brep_join.Breps)  # -> Faces, Edges, Vertices
line_3 = Line(StartPoint=polygon_center_3.CenterV, EndPoint=pull_point_3.ClosestPoint)
line_4 = ClusterOutput(line_3)
result = ClusterOutput(merge_5)
result_2 = ClusterOutput(merge_6)
center_v = ClusterOutput(polygon_center_3.CenterV)
vertices = ClusterOutput(deconstruct_brep_2.Vertices)

# ==== cluster Cluster_7
point = ClusterInput()
point_2 = Point(point)
X = ClusterInput()
Y = ClusterInput()
Z = ClusterInput()
center_box = CenterBox(Base=point_2, X=expr("x*.5", X), Y=expr("x*.5", Y), Z=expr("x*.5", Z))
deconstruct_brep = DeconstructBrep(Brep=center_box)  # -> Faces, Edges, Vertices
brep = Brep(center_box)
list_item = ListItem(List=deconstruct_brep.Faces, Index=0, Wrap=True)  # -> Item, Item1, Item2, Item3, Item4, Item5
cluster = Cluster_2(data=list_item.Item5, index=Slider(1, range=0..3))  # -> center_v, line_2
panel = Panel("-1.05")
unit_x = UnitX(Factor="4.55")
unit_x_2 = UnitX(Factor="-4.55")
cluster_2 = Cluster_5(data=list_item.Item1, factor="-4", index=Slider(0, range=0..3))  # -> geometry, line_2
cluster_3 = Cluster_5(data=list_item.Item1, factor="-4", index=Slider(2, range=0..3))  # -> geometry, line_2
cluster_4 = Cluster_2(data=list_item.Item1, index=Slider(3, range=0..3))  # -> center_v, line_2
cluster_5 = Cluster_2(data=list_item.Item3, index=Slider(3, range=0..3))  # -> center_v, line_2
cluster_6 = Cluster_5(data=list_item.Item3, factor="1.05", index=Slider(2, range=0..3))  # -> geometry, line_2
cluster_7 = Cluster_3(factor="1.05", data=list_item.Item3, index=Slider(0, range=0..3))  # -> geometry, geometry_2
cluster_8 = Cluster_2(data=list_item.Item4, index=Slider(3, range=0..3))  # -> center_v, line_2
cluster_9 = Cluster_3(factor="-1.05", data=list_item.Item1, index=Slider(3, range=0..3))  # -> geometry, geometry_2
cluster_10 = Cluster_4(factor="1.05", data=list_item.Item3, index=Slider(3, range=0..3))  # -> geometry, line_2
cluster_11 = Cluster_5(data=list_item.Item1, factor="-1.05", index=Slider(1, range=0..3))  # -> geometry, line_2
cluster_12 = Cluster_6(data=list_item.Item3, factor="1.05", index=Slider(1, range=0..3))  # -> geometry, line_2
move = Move(Geometry=cluster_9.geometry, Motion=unit_x_2)  # -> Geometry, Transform
move_2 = Move(Geometry=cluster_9.geometry_2, Motion=unit_x_2)  # -> Geometry, Transform
move_3 = Move(Geometry=cluster_12.geometry, Motion=unit_x)  # -> Geometry, Transform
move_4 = Move(Geometry=cluster_12.line_2, Motion=unit_x)  # -> Geometry, Transform
merge = Merge(Data1=cluster_2.geometry, Data2=cluster_3.geometry)
merge_2 = Merge(Data1=cluster_2.line_2, Data2=cluster_3.line_2)
merge_3 = Merge(Data1=flatten(cluster_4.line_2), Data2=flatten(cluster_5.line_2))  # -> flatten(FRONT_C)
merge_4 = Merge(Data1=flatten(cluster_4.center_v), Data2=flatten(cluster_5.center_v))  # -> flatten(FRONT_P)
merge_5 = Merge(Data1=flatten(move_4.Geometry), Data2=flatten(cluster_11.line_2), Data3=flatten(cluster_12.line_2))  # -> flatten(Result)
merge_6 = Merge(Data1=flatten(cluster_9.geometry_2), Data2=flatten(cluster_10.line_2), Data3=flatten(move_2.Geometry))  # -> flatten(Result)
merge_7 = Merge(Data1=flatten(move_3.Geometry), Data2=flatten(cluster_11.geometry), Data3=flatten(cluster_12.geometry))  # -> flatten(Result)
merge_8 = Merge(Data1=flatten(cluster_9.geometry), Data2=flatten(cluster_10.geometry), Data3=flatten(move.Geometry))  # -> flatten(Result)
merge_9 = Merge(Data1=flatten(cluster_6.geometry), Data2=flatten(cluster_7.geometry))
merge_10 = Merge(Data1=flatten(cluster_6.line_2), Data2=flatten(cluster_7.geometry_2))
st2_c = ClusterOutput(merge_2)
st2_p = ClusterOutput(merge)
front_p = ClusterOutput(merge_4)
front_c = ClusterOutput(merge_3)
side_p = ClusterOutput(merge_9)
side_c = ClusterOutput(merge_10)
bot_p = ClusterOutput(merge_7)
bot_c = ClusterOutput(merge_5)
top_p = ClusterOutput(merge_8)
top_c = ClusterOutput(merge_6)
brep_2 = ClusterOutput(brep)

# ==== cluster Cluster_8
point = ClusterInput()
X = ClusterInput()
Y = ClusterInput()
Z = ClusterInput()
point_2 = Point(point)
center_box = CenterBox(Base=point_2, X=expr("x*.5", X), Y=expr("x*.5", Y), Z=expr("x*.5", Z))
deconstruct_brep = DeconstructBrep(Brep=center_box)  # -> Faces, Edges, Vertices
list_item = ListItem(List=deconstruct_brep.Faces, Index=0, Wrap=True)  # -> Item, Item1, Item2, Item3, Item4, Item5
explode = Explode(Curve=list_item.Item4, Recursive=True)  # -> Segments, Vertices
explode_2 = Explode(Curve=list_item.Item5, Recursive=True)  # -> Segments, Vertices
list_item_2 = ListItem(List=explode.Segments, Index=0, Wrap=True)
list_item_3 = ListItem(List=explode_2.Segments, Index=0, Wrap=True)
point_on_curve = PointOnCurve(explode.Segments, parameter=0.5)
unit_z = UnitZ(Factor="1.05")
point_on_curve_2 = PointOnCurve(explode_2.Segments, parameter=0.5)
unit_z_2 = UnitZ(Factor="-1.05")
move = Move(Geometry=point_on_curve, Motion=unit_z)  # -> Geometry, Transform
move_2 = Move(Geometry=point_on_curve_2, Motion=unit_z_2)  # -> Geometry, Transform
cluster = Cluster_2(data=list_item.Item5, index=Slider(0, range=0..3))  # -> center_v, line_2
cluster_2 = Cluster_2(data=list_item.Item4, index=Slider(2, range=0..3))  # -> center_v, line_2
line = Line(StartPoint=move.Geometry, EndPoint=point_on_curve)
line_2 = Line(StartPoint=move_2.Geometry, EndPoint=point_on_curve_2)
brep = Brep(center_box)
brep_2 = ClusterOutput(brep)
bots_c = ClusterOutput(line)
bots_p = ClusterOutput(move.Geometry)
tops_p = ClusterOutput(move_2.Geometry)
tops_c = ClusterOutput(line_2)
bot_c = ClusterOutput(cluster_2.line_2)
top_c = ClusterOutput(cluster.line_2)
bot_p = ClusterOutput(cluster_2.center_v)
top_p = ClusterOutput(cluster.center_v)

# ==== cluster Remap: Remaps numbers
data = ClusterInput()
min = ClusterInput()
max = ClusterInput()
bnd = Bounds(Numbers=data)
dom = ConstructDomain(DomainStart=min, DomainEnd=max)
remap = RemapNumbers(Value=data, Source=bnd, Target=dom)  # -> Mapped, Clipped
R = ClusterOutput(remap.Mapped)

# ==== cluster Cluster_2
data = ClusterInput()
data_2 = Data(data)
polygon_center = PolygonCenter(Polyline=data_2)  # -> CenterV, CenterE, CenterA
explode = Explode(Curve=data_2, Recursive=True)  # -> Segments, Vertices
index = ClusterInput()
panel = Panel("3")
list_item = ListItem(List=explode.Segments, Index=index, Wrap=True)
point_on_curve = PointOnCurve(list_item, parameter=0.5)
line = Line(StartPoint=polygon_center.CenterV, EndPoint=point_on_curve)
center_v = ClusterOutput(polygon_center.CenterV)
line_2 = ClusterOutput(line)

# ==== cluster Cluster_3
data = ClusterInput()
data_2 = Data(data)
explode = Explode(Curve=data_2, Recursive=True)  # -> Segments, Vertices
index = ClusterInput()
panel = Panel("3")
list_item = ListItem(List=explode.Segments, Index=index, Wrap=True)
list_item_2 = ListItem(List=explode.Vertices, Index=0, Wrap=True)
point_on_curve = PointOnCurve(list_item, parameter=0.5)
line = Line(StartPoint=point_on_curve, EndPoint=list_item_2)
factor = ClusterInput()
unit_x = UnitX(Factor=factor)
move = Move(Geometry=line, Motion=unit_x)  # -> Geometry, Transform
move_2 = Move(Geometry=point_on_curve, Motion=unit_x)  # -> Geometry, Transform
geometry = ClusterOutput(move_2.Geometry)
geometry_2 = ClusterOutput(move.Geometry)

# ==== cluster Cluster_4
data = ClusterInput()
data_2 = Data(data)
explode = Explode(Curve=data_2, Recursive=True)  # -> Segments, Vertices
index = ClusterInput()
panel = Panel("3")
factor = ClusterInput()
list_item = ListItem(List=explode.Segments, Index=index, Wrap=True)
unit_x = UnitX(Factor=factor)
point_on_curve = PointOnCurve(list_item, parameter=0.5)
move = Move(Geometry=point_on_curve, Motion=unit_x)  # -> Geometry, Transform
geometry = ClusterOutput(move.Geometry)
line = Line(StartPoint=move.Geometry, EndPoint=point_on_curve)
line_2 = ClusterOutput(line)

# ==== cluster Cluster_5
data = ClusterInput()
data_2 = Data(data)
explode = Explode(Curve=data_2, Recursive=True)  # -> Segments, Vertices
index = ClusterInput()
list_item = ListItem(List=explode.Segments, Index=index, Wrap=True)
point_on_curve = PointOnCurve(list_item, parameter=1)
point_on_curve_2 = PointOnCurve(list_item, parameter=0.5)
factor = ClusterInput()
unit_x = UnitX(Factor=factor)
move = Move(Geometry=point_on_curve, Motion=unit_x)  # -> Geometry, Transform
move_2 = Move(Geometry=point_on_curve_2, Motion=unit_x)  # -> Geometry, Transform
line = Line(StartPoint=move_2.Geometry, EndPoint=move.Geometry)
geometry = ClusterOutput(move_2.Geometry)
line_2 = ClusterOutput(line)

# ==== cluster Cluster_6
data = ClusterInput()
data_2 = Data(data)
explode = Explode(Curve=data_2, Recursive=True)  # -> Segments, Vertices
index = ClusterInput()
list_item = ListItem(List=explode.Segments, Index=index, Wrap=True)
point_on_curve = PointOnCurve(list_item, parameter=0)
point_on_curve_2 = PointOnCurve(list_item, parameter=0.5)
factor = ClusterInput()
unit_x = UnitX(Factor=factor)
move = Move(Geometry=point_on_curve, Motion=unit_x)  # -> Geometry, Transform
move_2 = Move(Geometry=point_on_curve_2, Motion=unit_x)  # -> Geometry, Transform
line = Line(StartPoint=move_2.Geometry, EndPoint=move.Geometry)
geometry = ClusterOutput(move_2.Geometry)
line_2 = ClusterOutput(line)
