# Grasshopper definition lunartent-metaball.gh (Grasshopper 1.0.7)
# plug-ins: Kangaroo2 Components, Weaverbird

point = Point([Point(-11.26745289, 7.464670571, 0), Point(1.582547305, 9.528145827, 0), Point(3.724214003, -9.043131476, 0)])
pt = Point([Point(279, 218, 0), Point(-181, 218, 0), Point(49, -212, 0)])
terrain_generator = Slider(9, range=1..20)
length = Slider(1, range=0..1)
legend = Slider(9, range=0..25)
day = Slider(9, range=0..21)
strength = Slider(30, range=1..30)
seed = Slider(20, range=1..30)

# ---- group: RH_IN:run_analysis
boolean_toggle = BooleanToggle(False)

# ----
surface = Surface(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)
number_slider = Slider(2.8, range=0..10)
unit_z = UnitZ(Factor=Slider(17, range=1..100))
area = Area(Geometry=surface)  # -> Area, Centroid
points = GetPoint(pt, AtLeast=1, AtMost=2147483647, Realtime=True)
sun_position = GetNumber(day, AtLeast=1, AtMost=2147483647, Maximum=1.797693135e+308, Minimum=-1.797693135e+308)
seed_2 = GetNumber(seed, AtLeast=1, AtMost=2147483647, Maximum=1.797693135e+308, Minimum=-1.797693135e+308)
length_2 = GetNumber(length, AtLeast=1, AtMost=2147483647, Maximum=1.797693135e+308, Minimum=-1.797693135e+308)
strength_2 = GetNumber(strength, AtLeast=1, AtMost=2147483647, Maximum=1.797693135e+308, Minimum=-1.797693135e+308)
iterations = GetNumber(Slider(921, range=0..1000), AtLeast=1, AtMost=2147483647, Maximum=1.797693135e+308, Minimum=-1.797693135e+308)
height = GetNumber(legend, AtLeast=1, AtMost=2147483647, Maximum=1.797693135e+308, Minimum=-1.797693135e+308)
dimension = GetNumber(terrain_generator, AtLeast=1, AtMost=2147483647, Maximum=1.797693135e+308, Minimum=-1.797693135e+308)
extrude = Extrude(Base=surface, Direction=unit_z)
unit_z_2 = UnitZ(Factor=Slider(35, range=1..50))
scale_nu = ScaleNU(Geometry=surface, Plane=area.Centroid, ScaleX=number_slider, ScaleY=number_slider, ScaleZ=1)  # -> Geometry, Transform
move = Move(Geometry=extrude, Motion=unit_z_2)  # -> Geometry, Transform
mesh_sphere_ex = MeshSphereEx(Base=points, Radius=10, Count=5)
deconstruct_brep = DeconstructBrep(Brep=surface)  # -> Faces, Edges, Vertices
unit_z_3 = UnitZ(Factor=1)
populate_3d = Populate3D(Region=move.Geometry, Count=100, Seed=seed_2)
surface_2 = Surface(scale_nu.Geometry)
closest_point = ClosestPoint(Point=graft(point), Cloud=populate_3d)  # -> flatten(ClosestPoint), CPIndex, Distance
unit_z_4 = UnitZ(Factor=Slider(16, range=1..300))
unit_z_5 = UnitZ(Factor=1)
extrude_2 = Extrude(Base=surface_2, Direction=unit_z_4)
deconstruct_brep_2 = DeconstructBrep(Brep=surface_2)  # -> Faces, Edges, Vertices
brep = Brep([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])
vector_2pt = Vector2Pt(PointA=area.Centroid, PointB=closest_point.ClosestPoint, Unitize=False)  # -> Vector, Length
number_slider_2 = Slider(20, range=0..100)
list_item = ListItem(List=brep, Index=0, Wrap=True)
amplitude = Amplitude(Vector=vector_2pt.Vector, Amplitude=1)
settings_speed = SettingsSpeed()
populate_3d_2 = Populate3D(Region=extrude_2, Count=Slider(26, range=1..500), Seed=dimension)
area_2 = Area(Geometry=list_item)  # -> Area, Centroid
mesh_brep = MeshBrep(Brep=brep, Settings=settings_speed)
line_sdl = LineSDL(
    Start=closest_point.ClosestPoint,
    Direction=amplitude,
    Length=[Slider(9, range=1..50), Slider(16, range=1..50), Slider(5, range=1..50)])
delaunay_mesh = DelaunayMesh(Points=[populate_3d_2, deconstruct_brep_2.Vertices], Plane=PlaneXY(0, 0, 0))
project_point = ProjectPoint(Point=deconstruct_brep.Vertices, Direction=unit_z_3, Geometry=delaunay_mesh)  # -> Point, Index
list_item_2 = ListItem(List=project_point.Point, Index=0, Wrap=True)  # -> Item, Item1, Item2, Item3
_4point_surface = _4PointSurface(CornerA=list_item_2.Item, CornerB=list_item_2.Item1, CornerC=list_item_2.Item2, CornerD=list_item_2.Item3)
project_point_2 = ProjectPoint(Point=point, Direction=unit_z_5, Geometry=_4point_surface)  # -> Point, Index
mesh_surface = MeshSurface(Surface=_4point_surface, UCount=number_slider_2, VCount=number_slider_2, Overhang=True, Equalize=False)
mesh = Mesh(mesh_brep)
edgelengths = EdgeLengths(Mesh=mesh_surface, LengthFactor=length_2, Strength=strength_2)
anchor = Anchor(Point=project_point_2.Point, Target=closest_point.ClosestPoint, Strength=10000)
anchor_2 = Anchor(Point=project_point.Point, Strength=10000)
vertexloads = VertexLoads(Mesh=mesh_surface, Strength=-0.1)
end_points = EndPoints(Curve=line_sdl)  # -> Start, End
show = Show(G=mesh_surface)
orient = Orient(Geometry=graft(mesh), Source=area_2.Centroid, Target=end_points.End)  # -> Geometry, Transform
mesh_edges = MeshEdges(Mesh=delaunay_mesh)  # -> NakedEdges, InteriorEdges, NonManifoldEdges
weaverbird_s_constant_quads_split_subdiv = WeaverbirdsConstantQuadsSplitSubdivision(MeshCurves=delaunay_mesh, Level=3, SmoothNakedEdges=0)
unit_z_6 = UnitZ(Factor=Slider(30, range=1..30))

zombiesolver = ZombieSolver(
    GoalObjects=flatten([show, edgelengths, anchor_2, vertexloads, anchor]),
    Threshold=1e-10,
    Tolerance=0.01,
    MaxIterations=iterations)  # -> I, V, O
list_item_3 = ListItem(List=zombiesolver.O, Index=0, Wrap=True)  # -> Item, Item1
geometry = Geometry(zombiesolver.O)

move_2 = Move(Geometry=area.Centroid, Motion=unit_z_6)  # -> Geometry, Transform
unit_z_7 = UnitZ(Factor=Slider(5, range=1..10))
negative = Negative(Value=unit_z_7)
dash_pattern = DashPattern(Curve=mesh_edges.InteriorEdges, Pattern=Slider(0.8, range=0.1..3))  # -> Dashes, Gaps
curve = Curve(mesh_edges.NakedEdges)
deconstruct_mesh = DeconstructMesh(Mesh=weaverbird_s_constant_quads_split_subdiv)  # -> Vertices, Faces, Colours, Normals
month = Slider(12, range=1..12)
day_2 = Slider(1, range=1..30)
curve_2 = Curve([mesh_edges.NakedEdges, dash_pattern.Dashes])
extrude_3 = Extrude(Base=curve, Direction=negative)

panel = Panel("http://climate.onebuilding.org/WMO_Region_7_Antarctica/ATA_Antarctica/ATA_USA_U-Wisc.Baldrick.AWS-High.Polar.Plateau.890130_TMYx.zip")
downloadepw = LBDownloadWeather(weather_URL=panel)  # -> epw_file, stat_file, ddy_file; plug-in component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
importloc = LBImportLocation(epw_file=downloadepw.epw_file)  # -> location; plug-in component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

pcomp = Decompose(Point=deconstruct_mesh.Vertices)  # -> XComponent, YComponent, ZComponent
bnd = Bounds(Numbers=pcomp.ZComponent)
unit_z_8 = UnitZ(Factor=Slider(0.2, range=0..2))
remap = RemapNumbers(Value=pcomp.ZComponent, Source=bnd, Target=Domain(0, 1))  # -> Mapped, Clipped
simple_mesh = SimpleMesh(Brep=extrude_3)
addition = Addition(A=sun_position, B="2")
panel_2 = Panel(addition)
gradient = Gradient(LowerLimit=0, UpperLimit=1, Parameter=remap.Mapped, stops=[0: RGB(192, 192, 192), 0.86: RGB(255, 255, 255)])
deconstruct_mesh_2 = DeconstructMesh(Mesh=list_item_3.Item)  # -> Vertices, Faces, Colours, Normals
move_3 = Move(Geometry=curve_2, Motion=unit_z_8)  # -> Geometry, Transform

panel_3 = Panel("21")
analysisperiod = LBAnalysisPeriod(
    start_month=month,
    start_day=day_2,
    start_hour=sun_position,
    end_month=month,
    end_day=day_2,
    end_hour=addition,
    timestep="2")  # -> period, hoys, dates; plug-in component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

list_length = ListLength(List=deconstruct_mesh_2.Faces)
series = Series(Start=0, Step=1, Count=list_length)  # -> simplify(Series)
mesh_edges_2 = MeshEdges(Mesh=list_item_3.Item)  # -> NakedEdges, InteriorEdges, NonManifoldEdges
colrange = LBColorRange(index=height)  # -> colors; plug-in component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
mesh_colours = MeshColours(Mesh=weaverbird_s_constant_quads_split_subdiv, Colours=gradient)
gradient_2 = Gradient(LowerLimit=0, UpperLimit=list_length, Parameter=series, stops=[0: RGB(255, 130, 160), 1: RGB(0, 99, 177)])

sunpath = LBSunPath(north="20", location=importloc, hoys=analysisperiod.hoys, center_pt=move_2.Geometry, scale=0.7, daily=Toggle(True))  # -> report, vectors, altitudes, azimuths, hoys, sun_pts, analemma, daily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; plug-in component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

legendpar = LBLegendParameters(colors=colrange)  # -> leg_par; plug-in component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
dash_pattern_2 = DashPattern(Curve=mesh_edges_2.InteriorEdges, Pattern=Slider(0.4, range=0.1..2))  # -> Dashes, Gaps
curve_3 = Curve(mesh_edges_2.NakedEdges)
mesh_colours_2 = MeshColours(Mesh=list_item_3.Item, Colours=gradient_2)

# ---- group: Run Me!
toggle = BooleanToggle(True)

# ----
directsunhours = LBDirectSunHours(
    vectors=flatten(sunpath.vectors),
    timestep="2",
    geometry=flatten(weaverbird_s_constant_quads_split_subdiv),
    context=flatten(list_item_3.Item),
    grid_size="1",
    offset_dist="0.1",
    legend_par=legendpar,
    run=boolean_toggle)  # -> report, points, results, mesh, legend, title, int_mtx; plug-in component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

list_item_4 = ListItem(List=sunpath.sun_pts, Index=2, Wrap=True)
mesh_sphere = MeshSphere(Base=list_item_4, Radius=4, UCount=5, VCount=5)
curve_4 = Curve(sunpath.daily)
mesh_colours_3 = MeshColours(Mesh=mesh_sphere, Colours=ColourSwatch(SwatchColor=RGB(185, 186, 112)))
list_item_5 = ListItem(List=directsunhours.legend, Index=0, Wrap=True)
mesh_2 = Mesh(list_item_5)
panel_4 = Panel("""0
1""")
deconstruct_mesh_3 = DeconstructMesh(Mesh=mesh_2)  # -> Vertices, Faces, Colours, Normals
cull_index = CullIndex(List=directsunhours.legend, Indices=panel_4, Wrap=True)
list_item_6 = ListItem(List=deconstruct_mesh_3.Vertices, Index=0, Wrap=True)
list_length_2 = ListLength(List=cull_index)
mesh_3 = Mesh([mesh_colours, mesh_colours_2, simple_mesh, orient.Geometry])
mesh_4 = Mesh([mesh_colours_2, simple_mesh, orient.Geometry, mesh_2, directsunhours.mesh, mesh_colours_3])
curve_5 = Curve([move_3.Geometry, line_sdl, curve_3, dash_pattern_2.Dashes])
unit_x = UnitX(Factor=7)
stream_filter = StreamFilter(Gate=boolean_toggle, Stream0=mesh_3, Stream1=mesh_4)  # -> flatten(Stream)
series_2 = Series(Start=0, Step=Slider(10.6, range=0.1..20), Count=list_length_2)
move_4 = Move(Geometry=list_item_6, Motion=unit_x)  # -> Geometry, Transform
concatenate = Concatenate(FragmentA=cull_index, FragmentB=" HRS")
unit_y = UnitY(Factor=series_2)
move_5 = Move(Geometry=move_4.Geometry, Motion=unit_y)  # -> Geometry, Transform
unit_y_2 = UnitY(Factor=Slider(6.5, range=0.1..10))
move_6 = Move(Geometry=move_5.Geometry, Motion=unit_y_2)  # -> Geometry, Transform
bool = Boolean(invert(True))

# ---- group: RH_OUT:terrainedge
mesh_5 = Mesh([stream_filter, mesh_sphere_ex])

# ----
c_script = CSharpScript(face="Verdana", bold=bool, size=Slider(2.181, range=0..11), content=concatenate, pl=move_6.Geometry)  # -> out, A; inputs face: String, bold: Boolean, italics: Boolean, size: Double, content: String, pl: Plane
# ---------- c_script: C# usings ----------
using System.IO;
using System.Linq;
using System.Data;
using System.Drawing;
using System.Reflection;
using System.Windows.Forms;
using System.Xml;
using System.Xml.Linq;
using System.Runtime.InteropServices;

using Rhino.DocObjects;
using Rhino.Collections;
using GH_IO;
using GH_IO.Serialization;
# ---------- c_script: C# ----------
    if(size == 0)
      size = 1;

    if(!string.IsNullOrEmpty(face) && size > 0 && !string.IsNullOrEmpty(content) &&
      pl.IsValid)
    {
      using (var doc = Rhino.RhinoDoc.CreateHeadless(null))
      {
        var te = doc.Objects.AddText(content, pl, size, face, bold, italics);
        var txt = doc.Objects.Find(te) as Rhino.DocObjects.TextObject;

        if(txt != null)
        {
          var tt = txt.Geometry as Rhino.Geometry.TextEntity;
          A = tt.Explode();
        }
      }
    }
# ---------- end c_script ----------
curve_6 = Curve([move_3.Geometry, line_sdl, curve_4, c_script.A, curve_3, dash_pattern_2.Dashes])
stream_filter_2 = StreamFilter(Gate=boolean_toggle, Stream0=curve_5, Stream1=curve_6)  # -> flatten(Stream)

# ---- group: RH_OUT:curveskangar
curve_7 = Curve(stream_filter_2)
