# Grasshopper definition lunartent.gh (Grasshopper 1.0.7)
# plug-ins: Kangaroo2 Components, Pufferfish

point = Point([Point(-11.26745289, 7.464670571, 0), Point(1.582547305, 9.528145827, 0), Point(3.724214003, -9.043131476, 0)])
surface = Surface(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)
number_slider = Slider(2.8, range=0..10)
terrain_generator = Slider(1, range=1..20)
length = Slider(1, range=0..1)
legend = Slider(22, range=0..25)
strength = Slider(30, range=1..30)
seed = Slider(20, range=1..30)
area = Area(Geometry=surface)  # -> Area, Centroid
unit_z = UnitZ(Factor=Slider(17, range=1..100))
scale_nu = ScaleNU(Geometry=surface, Plane=area.Centroid, ScaleX=number_slider, ScaleY=number_slider, ScaleZ=1)  # -> Geometry, Transform
seed_2 = GetNumber(seed, AtLeast=1, AtMost=2147483647, Maximum=1.797693135e+308, Minimum=-1.797693135e+308)
length_2 = GetNumber(length, AtLeast=1, AtMost=2147483647, Maximum=1.797693135e+308, Minimum=-1.797693135e+308)
strength_2 = GetNumber(strength, AtLeast=1, AtMost=2147483647, Maximum=1.797693135e+308, Minimum=-1.797693135e+308)
iterations = GetNumber(Slider(921, range=0..1000), AtLeast=1, AtMost=2147483647, Maximum=1.797693135e+308, Minimum=-1.797693135e+308)
legend_2 = GetNumber(legend, AtLeast=1, AtMost=2147483647, Maximum=1.797693135e+308, Minimum=-1.797693135e+308)
terrain_seed = GetNumber(terrain_generator, AtLeast=1, AtMost=2147483647, Maximum=1.797693135e+308, Minimum=-1.797693135e+308)
extrude = Extrude(Base=surface, Direction=unit_z)
unit_z_2 = UnitZ(Factor=Slider(35, range=1..50))
move = Move(Geometry=extrude, Motion=unit_z_2)  # -> Geometry, Transform
deconstruct_brep = DeconstructBrep(Brep=surface)  # -> Faces, Edges, Vertices
unit_z_3 = UnitZ(Factor=1)
populate_3d = Populate3D(Region=move.Geometry, Count=100, Seed=seed_2)
surface_2 = Surface(scale_nu.Geometry)
closest_point = ClosestPoint(Point=graft(point), Cloud=populate_3d)  # -> flatten(ClosestPoint), CPIndex, Distance
unit_z_4 = UnitZ(Factor=Slider(16, range=1..300))
unit_z_5 = UnitZ(Factor=1)
extrude_2 = Extrude(Base=surface_2, Direction=unit_z_4)
deconstruct_brep_2 = DeconstructBrep(Brep=surface_2)  # -> Faces, Edges, Vertices
vector_2pt = Vector2Pt(PointA=area.Centroid, PointB=closest_point.ClosestPoint, Unitize=False)  # -> Vector, Length
number_slider_2 = Slider(20, range=0..100)
amplitude = Amplitude(Vector=vector_2pt.Vector, Amplitude=1)
populate_3d_2 = Populate3D(Region=extrude_2, Count=Slider(26, range=1..500), Seed=terrain_seed)
delaunay_mesh = DelaunayMesh(Points=[populate_3d_2, deconstruct_brep_2.Vertices], Plane=PlaneXY(0, 0, 0))
project_point = ProjectPoint(Point=deconstruct_brep.Vertices, Direction=unit_z_3, Geometry=delaunay_mesh)  # -> Point, Index
list_item = ListItem(List=project_point.Point, Index=0, Wrap=True)  # -> Item, Item1, Item2, Item3
_4point_surface = _4PointSurface(CornerA=list_item.Item, CornerB=list_item.Item1, CornerC=list_item.Item2, CornerD=list_item.Item3)
project_point_2 = ProjectPoint(Point=point, Direction=unit_z_5, Geometry=_4point_surface)  # -> Point, Index
mesh_surface = MeshSurface(Surface=_4point_surface, UCount=number_slider_2, VCount=number_slider_2, Overhang=True, Equalize=False)
line_sdl = LineSDL(
    Start=closest_point.ClosestPoint,
    Direction=amplitude,
    Length=[Slider(9, range=1..50), Slider(16, range=1..50), Slider(5, range=1..50)])
edgelengths = EdgeLengths(Mesh=mesh_surface, LengthFactor=length_2, Strength=strength_2)
anchor = Anchor(Point=project_point_2.Point, Target=closest_point.ClosestPoint, Strength=10000)
anchor_2 = Anchor(Point=project_point.Point, Strength=10000)
vertexloads = VertexLoads(Mesh=mesh_surface, Strength=-0.1)
end_points = EndPoints(Curve=line_sdl)  # -> Start, End
show = Show(G=mesh_surface)
mesh_edges = MeshEdges(Mesh=delaunay_mesh)  # -> NakedEdges, InteriorEdges, NonManifoldEdges
triremesh = TriRemesh(Geometry=delaunay_mesh, Sharp=Toggle(True), Iterations=25)  # -> Triangulation, Dual, Creases

zombiesolver = ZombieSolver(
    GoalObjects=flatten([show, edgelengths, anchor_2, vertexloads, anchor]),
    Threshold=1e-10,
    Tolerance=0.01,
    MaxIterations=iterations)  # -> I, V, O
list_item_2 = ListItem(List=zombiesolver.O, Index=0, Wrap=True)  # -> Item, Item1
geometry = Geometry(zombiesolver.O)

unit_z_6 = UnitZ(Factor=Slider(5, range=1..10))
dash_pattern = DashPattern(Curve=mesh_edges.InteriorEdges, Pattern=Slider(0.8, range=0.1..3))  # -> Dashes, Gaps
negative = Negative(Value=unit_z_6)
curve = Curve(mesh_edges.NakedEdges)
curve_2 = Curve([mesh_edges.NakedEdges, dash_pattern.Dashes])
extrude_3 = Extrude(Base=curve, Direction=negative)
unit_z_7 = UnitZ(Factor=Slider(0.5, range=0..2))

panel = Panel("http://climate.onebuilding.org/WMO_Region_4_North_and_Central_America/USA_United_States_of_America/WI_Wisconsin/USA_WI_Madison-Dane.County.Rgnl.AP-Truax.Field.726410_TMY3.zip")
downloadepw = LBDownloadWeather(weather_URL=panel)  # -> epw_file, stat_file, ddy_file; plug-in component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
importloc = LBImportLocation(epw_file=downloadepw.epw_file)  # -> location; plug-in component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

simple_mesh = SimpleMesh(Brep=extrude_3)
move_2 = Move(Geometry=curve_2, Motion=unit_z_7)  # -> Geometry, Transform
deconstruct_mesh = DeconstructMesh(Mesh=list_item_2.Item)  # -> Vertices, Faces, Colours, Normals

analysisperiod = LBAnalysisPeriod(start_month="6", start_day="21", start_hour=0, end_month="6", end_day="21", end_hour=23, timestep="1")  # -> period, hoys, dates; plug-in component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

list_length = ListLength(List=deconstruct_mesh.Faces)
series = Series(Start=0, Step=1, Count=list_length)  # -> simplify(Series)
mesh_edges_2 = MeshEdges(Mesh=list_item_2.Item)  # -> NakedEdges, InteriorEdges, NonManifoldEdges
colrange = LBColorRange(index=legend_2)  # -> colors; plug-in component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
gradient = Gradient(LowerLimit=0, UpperLimit=list_length, Parameter=series, stops=[0: RGB(255, 130, 160), 1: RGB(0, 99, 177)])

sunpath = LBSunPath(north="20", location=importloc, hoys=analysisperiod.hoys, scale=1)  # -> report, vectors, altitudes, azimuths, hoys, sun_pts, analemma, daily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; plug-in component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

legendpar = LBLegendParameters(colors=colrange)  # -> leg_par; plug-in component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
dash_pattern_2 = DashPattern(Curve=mesh_edges_2.InteriorEdges, Pattern=Slider(0.4, range=0.1..2))  # -> Dashes, Gaps
curve_3 = Curve(mesh_edges_2.NakedEdges)
mesh_colours = MeshColours(Mesh=list_item_2.Item, Colours=gradient)

# ---- group: Run Me!
toggle = BooleanToggle(True)

# ----
directsunhours = LBDirectSunHours(
    vectors=flatten(sunpath.vectors),
    timestep="1",
    geometry=flatten(triremesh.Triangulation),
    context=flatten(list_item_2.Item),
    grid_size="2",
    offset_dist="0.1",
    legend_par=legendpar,
    run=toggle)  # -> report, points, results, mesh, legend, title, int_mtx; plug-in component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

list_item_3 = ListItem(List=directsunhours.legend, Index=0, Wrap=True)
mesh = Mesh(list_item_3)
panel_2 = Panel("""0
1""")
deconstruct_mesh_2 = DeconstructMesh(Mesh=mesh)  # -> Vertices, Faces, Colours, Normals
cull_index = CullIndex(List=directsunhours.legend, Indices=panel_2, Wrap=True)
list_item_4 = ListItem(List=deconstruct_mesh_2.Vertices, Index=0, Wrap=True)
list_length_2 = ListLength(List=cull_index)

# ---- group: RH_OUT:mesh2
mesh_2 = Mesh(directsunhours.mesh)

# ----
unit_x = UnitX(Factor=7)
series_2 = Series(Start=0, Step=Slider(10.6, range=0.1..20), Count=list_length_2)
mesh_3 = Mesh(mesh)
offset_mesh = OffsetMesh(Mesh=mesh_3, Distance=1, BothSides=True, CreateSolid=True)
move_3 = Move(Geometry=list_item_4, Motion=unit_x)  # -> Geometry, Transform
concatenate = Concatenate(FragmentA=cull_index, FragmentB=" HRS")
unit_y = UnitY(Factor=series_2)

# ---- group: RH_OUT:meshlegend
mesh_4 = Mesh(offset_mesh)

# ----
move_4 = Move(Geometry=move_3.Geometry, Motion=unit_y)  # -> Geometry, Transform
unit_y_2 = UnitY(Factor=Slider(6.5, range=0.1..10))
move_5 = Move(Geometry=move_4.Geometry, Motion=unit_y_2)  # -> Geometry, Transform
bool = Boolean(True)
c_script = CSharpScript(face="Verdana", bold=bool, size=Slider(2.181, range=0..11), content=concatenate, pl=move_5.Geometry)  # -> out, A; inputs face: String, bold: Boolean, italics: Boolean, size: Double, content: String, pl: Plane
# ---------- c_script: C# usings ----------
using System.IO;
using System.Linq;
using System.Data;
using System.Drawing;
using System.Reflection;
using System.Windows.Forms;
using System.Xml;
using System.Xml.Linq;
using System.Runtime.InteropServices;

using Rhino.DocObjects;
using Rhino.Collections;
using GH_IO;
using GH_IO.Serialization;
# ---------- c_script: C# ----------
    if(size == 0)
      size = 1;

    if(!string.IsNullOrEmpty(face) && size > 0 && !string.IsNullOrEmpty(content) &&
      pl.IsValid)
    {
      using (var doc = Rhino.RhinoDoc.CreateHeadless(null))
      {
        var te = doc.Objects.AddText(content, pl, size, face, bold, italics);
        var txt = doc.Objects.Find(te) as Rhino.DocObjects.TextObject;

        if(txt != null)
        {
          var tt = txt.Geometry as Rhino.Geometry.TextEntity;
          A = tt.Explode();
        }
      }
    }
# ---------- end c_script ----------
boundary_surfaces = BoundarySurfaces(Edges=c_script.A)  # -> flatten(Surfaces)

# ---- group: RH_OUT:ground
groundmesh = Mesh(mesh_colours)

# ---- group: RH_OUT:terrainedge
mesh_5 = Mesh([simple_mesh, mesh_2, mesh_4, groundmesh])

# ---- group: RH_OUT:notes
surface_3 = Surface(boundary_surfaces)

# ---- group: RH_OUT:curveskangar
curve_4 = Curve([curve_3, dash_pattern_2.Dashes, line_sdl, move_2.Geometry])
