# Grasshopper definition mesh_spots.gh (Grasshopper 1.0.7)

# ---- group: RH_IN:points
pt = Point()

# ----
mesh = Mesh(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)
mesh_sphere = MeshSphere(Base=pt, Radius=Slider(0.01, range=0.001..0.01), UCount=10, VCount=20)

# ---- group: RH_OUT:mesh
mesh_2 = Mesh([mesh_sphere, mesh])
