# Grasshopper definition metaballTable2.gh (Grasshopper 1.0.7)
# plug-ins: Kangaroo2 Components

number_slider = Slider(350, range=350..1000)
pt = Point([Point(279, 218, 0), Point(-181, 218, 0), Point(49, -212, 0)])

height = GetNumber(number_slider, AtLeast=1, AtMost=2147483647, Maximum=1.797693135e+308, Minimum=-1.797693135e+308)
dimension = GetNumber(Slider(800, range=350..1000), AtLeast=1, AtMost=2147483647, Maximum=1.797693135e+308, Minimum=-1.797693135e+308)
points = GetPoint(pt, AtLeast=1, AtMost=2147483647, Realtime=True)

dom = ConstructDomain(DomainStart=expr("-x/2", dimension), DomainEnd=expr("x/2", dimension))
Z = UnitZ(Factor=height)
rectangle = Rectangle(Plane=PlaneXY(0, 0, 0), XSize=dom, YSize=dom, Radius=0)  # -> Rectangle, Length
scale = Panel("0.1")
move = Move(Geometry=rectangle.Rectangle, Motion=Z)  # -> Geometry, Transform
scale_2 = Scale(Geometry=points, Center=Point(0, 0, 0), Factor=scale)  # -> Geometry, Transform
scale_3 = Scale(Geometry=move.Geometry, Center=Point(0, 0, 0), Factor=scale)  # -> Geometry, Transform
pop2d = Populate2D(Region=scale_3.Geometry, Count="10", Seed=1)
item = ListItem(List=pop2d, Index=0, Wrap=True)
cp = ClosestPoint(Point=scale_2.Geometry, Cloud=pop2d)  # -> ClosestPoint, CPIndex, Distance
pdecon = Deconstruct(Point=item)  # -> XComponent, YComponent, ZComponent
ln = Line(StartPoint=cp.ClosestPoint, EndPoint=scale_2.Geometry)
range = Range(Domain=pdecon.ZComponent, Steps=Slider(17, range=5..25))
ext = ExtendCurve(Curve=ln, Type=0, Start="0", End="10")
item_2 = ListItem(List=reverse(range), Index=0, Wrap=True)
divide = DivideCurve(Curve=ext, Count=10, Kinks=False)  # -> flatten(Points), Tangents, Parameters
lng = ListLength(List=divide.Points)
dup = DuplicateData(Data=Slider(39.123, range=0..100), Number="10", Order=True)
dup_2 = DuplicateData(Data=Slider(2.212, range=0..100), Number=lng, Order=True)
pt_2 = ConstructPoint(XCoordinate=0, YCoordinate=0, ZCoordinate=range)
bool = Boolean(lng)
merge = Merge(Data1=flatten(divide.Points), Data2=flatten(pop2d))
merge_2 = Merge(Data1=dup_2, Data2=dup)
filter = StreamFilter(Gate=bool, Stream1=merge_2)
metaball_t = MetaBallTCustom(Points=merge, Charge=filter, Plane=pt_2, Threshold=Slider(0.506, range=0..1))
scale_4 = Scale(Geometry=metaball_t, Center=Point(0, 0, 0), Factor="10")  # -> Geometry, Transform
crv = Curve(simplify(scale_4.Geometry))
explode = Explode(Curve=crv, Recursive=True)  # -> flatten(Segments), Vertices
dupln = RemoveDuplicateLines(Lines=explode.Segments, Tolerance=0.01)
join = JoinCurves(Curves=dupln, Preserve=False)
division = Division(A=number_slider, B=Slider(3, range=0..10))
redpline = Reduce(Polyline=join, Tolerance=1)  # -> Polyline, Reduction
midpt = CurveMiddle(Curve=redpline.Polyline)
mesh_sphere = MeshSphere(Base=points, Radius=division, UCount=10, VCount=20)
pdecon_2 = Deconstruct(Point=midpt)  # -> XComponent, YComponent, ZComponent
deconstruct_mesh = DeconstructMesh(Mesh=mesh_sphere)  # -> Vertices, Faces, Colours, Normals
bnd = Bounds(Numbers=pdecon_2.ZComponent)
list_length = ListLength(List=deconstruct_mesh.Faces)
dedomain = DeconstructDomain(Domain=bnd)  # -> Start, End
construct_domain = ConstructDomain(DomainStart=0, DomainEnd=list_length)
gradient = Gradient(
    LowerLimit=0,
    UpperLimit=dedomain.End,
    Parameter=pdecon_2.ZComponent,
    stops=[0.125: RGB(0, 0, 0), 0.499: RGB(255, 251, 0), 0.868: RGB(255, 0, 255)])
series = Series(Start=0, Step=1, Count=list_length)
c_script = CSharpScript(crv=redpline.Polyline, color=gradient)  # -> out, A; inputs crv: Curve, color: Color
# ---------- c_script: C# ----------
    var c = color.R + "," + color.G + "," + color.B;
    crv.SetUserString("color", c);
    A = crv;
# ---------- end c_script ----------
gradient_2 = Gradient(
    LowerLimit=0,
    UpperLimit=list_length,
    Parameter=series,
    stops=[0: RGB(234, 38, 0), 0.25: RGB(234, 126, 0), 0.5: RGB(254, 244, 84), 0.75: RGB(173, 203, 249), 1: RGB(75, 107, 169)])
mesh_colours = MeshColours(Mesh=mesh_sphere, Colours=gradient_2)

# ---- group: RH_OUT:limit
crv_2 = Curve(rectangle.Rectangle)

# ----
preview = CustomPreview(Geometry=redpline.Polyline, Material=gradient)

# ---- group: RH_OUT:crvs
crv_3 = Curve(c_script.A)

# ----
preview_2 = CustomPreview(
    Geometry=mesh_colours,
    Material={diffuse=RGB(221, 160, 221), emission=RGB(66, 48, 66), shine=0.5, specular=RGB(255, 255, 255), transparency=0})

# ---- group: RH_OUT:mesh
mesh = Mesh(mesh_colours)
