# Grasshopper definition server_space_syntax.gh (Grasshopper 1.0.7)
# plug-ins: Kangaroo2 Components

# Floor distribution
# Reset SOLVER
subtracted_corridor_area = Data()
flatten_tree = FlattenTree(Path="{0}")
actual_area_per_shpere_with_subtracted_c = Panel(subtracted_corridor_area)  # "Actual area per shpere with subtracted corridor"

# ----
# Floor distribution
_0_floor = Panel("""0
1
2
3
4
5""")
_1_floor = Panel("""6
7
8
9
10""")
_2_floor = Panel("""11
12
13
14
15
16""")
_3_floor = Panel("""17
18
19
20""")
merge = Merge(Data1=_0_floor, Data2=_1_floor, Data3=_2_floor, Data4=_3_floor)  # -> flatten(Result)
sort_list = SortList(Keys=merge)  # -> Keys, ValuesValuesA
check_if_all_floors_are_connected = Panel(sort_list.Keys)
lab = Panel("""Lift L-0
LNS Res L
Loading
Rovers
O2/H20 Sup
Airlocks
W.C L-01
Lift L-01
Airlocks
Bio-Tech
Proto
Admin L
Staff
Robots Bay
W.C L-02
Lift L-02
Airlocks L-02
Data Cent
RF Signal
W.C L-03
Lift L-03""")
lab_area = Panel("""20
20
20
20
20
15
15
20
15
15
150
15
50
60
15
20
15
30
20
15
20""")
overall_connection_logic = Panel("""1 2 7
2 3 4 5
10
0
0
2
7 14
9 15
10
10
7
12 13
15
15
15 19
11 20
13
18 19
20
20
17""")
names_of_overall_connection_logic = Panel("""2
3
1 3
0
2
4
1
3
9 7
10 0
11 2 4
5""")

# ----
# Lab function per floor
# Floor distribution Hospital
entwine = Entwine(Branch00=_0_floor, Branch01=_1_floor, Branch02=_2_floor, Branch03=_3_floor, FlattenInputs=True)
lab_function_per_floor = Data(entwine)
panel = Panel(lab_function_per_floor)

height_of_the_room = Panel("3.5")
actual_area_per_shpere = Panel(flatten_tree)
areas = Panel("""20
80
150
80
50
120
20
60
20
20
20
20""")

division = Division(A=actual_area_per_shpere_with_subtracted_c, B=areas)
multiplication = Multiplication(A=division, B=100)
ghpython_script = GhPythonScript(x=multiplication)  # -> out, a
# ---------- ghpython_script: Python ----------
a = round(x, 1)
# ---------- end ghpython_script ----------
concatenate = Concatenate(FragmentA=ghpython_script.a, FragmentB=" %")

sort_list_2 = SortList(Keys=lab_area)  # -> Keys, ValuesValuesA
list_item = ListItem(List=sort_list_2.Keys, Index=0, Wrap=True)  # -> Item1, Item
max_area = Panel(list_item.Item1)
min_area = Panel(list_item.Item)

areas_2 = Panel(concatenate)
average = Average(Input=ghpython_script.a)
average_2 = Panel(average)

# ----
# Area multiplier
number_slider = Slider(0.75, range=0.5..1.25)
average_of_desired_area_achieved = Panel(average_2)
factor_to_alter_distance_between_functio = Slider(0.96, range=0.5..1)  # "Factor to alter distance between function clusters"
factor_to_alter_all_distances = Slider(1, range=0.2..1)
desired_area_per_sphere = Panel("15")
corridor_width_m = Panel("1.5")

graft_tree = GraftTree(Tree=lab_area, IncludeEmptyLists=True, IncludeNullItems=True)  # -> simplify(Tree)
lab_area_2 = Panel(graft_tree)
desired_area_per_sphere_2 = Panel(desired_area_per_sphere)

seperator_is_space = Panel(" ")
text_split = TextSplit(Text=overall_connection_logic, Separators=seperator_is_space)  # -> simplify(Result)
main_connections = Panel(text_split)

ghpython_script_2 = GhPythonScript(x=lab_area_2, y=desired_area_per_sphere_2)  # -> out, a, div_num; inputs x: list, y: list
# ---------- ghpython_script_2: Python ----------
__author__ = "solty"
__version__ = "2021.02.03"

import rhinoscriptsyntax
import math

b=[]
c=[]

if x[0] > y[0]:
    
    b = x[0] % y[0]
    c = (x[0] - b) / y[0]
    a = y[0] + (b / c)
    div_num = c
else:
    a = x
    b = 'null'
    div_num = 1
print x
print y
print a
print b
# ---------- end ghpython_script_2 ----------
merged_connections = Data(text_split)
areas_3 = Panel(ghpython_script_2.a)
division_of_each_function = Panel(ghpython_script_2.div_num)
duplicate_data = DuplicateData(Data=ghpython_script_2.a, Number=ghpython_script_2.div_num, Order=True)  # -> simplify(Data)
lab_area_3 = Panel(duplicate_data)
indices = ListIndices(list=duplicate_data)
main_connection_logic = Data(merged_connections)
# Rename functions
lab_area_4 = Panel(indices)
duplicate_data_2 = DuplicateData(Data=graft(lab), Number=ghpython_script_2.div_num, Order=True)  # -> simplify(Data)
cross_reference = CrossReference(ListListA=indices, ListListB=indices, CrossMode=7)  # -> ListListA, ListListB
# I'm trying to use internalised sphere to appear on server, w/o luck
panel_2 = Panel(main_connection_logic)
interconnection_logic = Panel(cross_reference.ListListA)
list_length = ListLength(List=duplicate_data_2)
names = Panel(duplicate_data_2)
series = Series(Start="0", Step="1", Count=list_length)
interconnection_logic_2 = Panel(cross_reference.ListListB)
concatenate_2 = Concatenate(Fragment_A=duplicate_data_2, A="_", Fragment_B=series)
# checking the logic behind connections
lab_names = Panel(concatenate_2)

simplify_tree = SimplifyTree(Tree=concatenate_2, Front=False)

lab_names_2 = Panel(simplify_tree)
panel_3 = Panel(simplify_tree)

# ----
# Specify connections in divided functions
# Cross reference logic: Use upper strict to label the connections based on the last values >> later specify the overall connection based on first item of the list
flatten_tree_2 = FlattenTree(Tree=duplicate_data, Path="{0}")
indices_2 = ListIndices(list=flatten_tree_2)
unflatten_tree = UnflattenTree(Tree=indices_2, Guide=duplicate_data)
function_indices = Data(unflatten_tree)
cross_reference_2 = CrossReference(ListListA=function_indices, ListListB=function_indices, CrossMode=7)  # -> ListListA, ListListB
interconnection_logic_3 = Panel(cross_reference_2.ListListA)
interconnection_logic_4 = Panel(cross_reference_2.ListListB)
flatten_tree_3 = FlattenTree(Tree=cross_reference_2.ListListA, Path="{0}")
interconnection_logic_5 = Panel(flatten_tree_3)
flatten_tree_4 = FlattenTree(Tree=cross_reference_2.ListListB, Path="{0}")
interconnection_logic_6 = Panel(flatten_tree_4)

indices_on_branches = Data(function_indices)
rephrased_names = Panel(concatenate_2)
indices_on_branches_2 = Panel(indices_on_branches)
function_indices_2 = Panel(function_indices)
tree_statistics = TreeStatistics(Tree=main_connection_logic)  # -> Paths, Length, Count
tree_branch = TreeBranch(Tree=indices_on_branches_2, Path=tree_statistics.Paths, MaintainPaths=True)

# ----
# alternative <index>
# alternative <index>
list_length_2 = ListLength(List=main_connection_logic)
list_length_3 = ListLength(List=main_connection_logic)
duplicate_data_3 = DuplicateData(Data="0", Number=list_length_2, Order=True)  # -> simplify(Data)
series_2 = Series(Start="0", Step="1", Count=list_length_3)

# ----
# Create right paths
list_item_2 = ListItem(List=tree_branch, Index=duplicate_data_3, Wrap=True)
tree_statistics_2 = TreeStatistics(Tree=list_item_2)  # -> Paths, Length, Count
list_item_3 = ListItem(List=tree_branch, Index=0, Wrap=True)
construct_path = ConstructPath(Indices=list_item_3)  # -> flatten(Branch)
replace_paths = ReplacePaths(Data=list_item_2, Search=tree_statistics_2.Paths, Replace=construct_path)
panel_4 = Panel(construct_path)

panel_5 = Panel("""1
2
5
6""")
# grab the first sphere to connect from
# first item
# from the branch
# alternative <index>
# alternative <index>
# Create right paths
# Specify connections in divided functions
panel_6 = Panel("""6
1
54
5""")

# ----
# grab the first sphere to connect from
tree_statistics_3 = TreeStatistics(Tree=indices_on_branches_2)  # -> Paths, Length, Count
list_item_4 = ListItem(List=tree_statistics_3.Paths, Index=main_connection_logic, Wrap=True)
tree_branch_2 = TreeBranch(Tree=indices_on_branches_2, Path=list_item_4, MaintainPaths=False)
list_item_5 = ListItem(List=tree_branch_2, Index=0, Wrap=True)
flatten_tree_5 = FlattenTree(Tree=list_item_5, Path="{0}")
unflatten_tree_2 = UnflattenTree(Tree=flatten_tree_5, Guide=replace_paths)

list_length_4 = ListLength(List=flatten_tree_2)
series_3 = Series(Start="0", Step="1", Count=list_length_4)
c_script_create_tree = CSharpScript(path=flatten_tree_4, data=flatten_tree_3)  # -> out, r; inputs path: Int32, data: Int32
# ---------- c_script_create_tree: C# usings ----------
using System.Linq;
using Grasshopper.Kernel.Special;
# ---------- c_script_create_tree: C# ----------
    Grasshopper.DataTree<int> tree = new Grasshopper.DataTree<int>();

    tree.Add(data, new GH_Path(path));


    r = tree;
# ---------- end c_script_create_tree ----------
interconnection_logic_7 = Panel(c_script_create_tree.r)

ghpython_script_3 = GhPythonScript()  # -> a; inputs x: list
# ---------- ghpython_script_3: Python ----------
import rhinoscriptsyntax as rs


repeats_count = 0


for xi in x:
  if (xi - y) < z:
    repeats_count = repeats_count + 1

if repeats_count >= 2:
  a = 0
else:
  a = 1
  
print z
# ---------- end ghpython_script_3 ----------
null_item = NullItem(Item=c_script_create_tree.r)  # -> NullFlags, InvalidFlags, Description
main_connection_on_branches = Panel(unflatten_tree_2)
interconnection_logic_8 = Panel(null_item.NullFlags)
merge_2 = Merge(Data1=unflatten_tree_2, Data2=c_script_create_tree.r)

# ----
# Inter room connections
indices_3 = ListIndices(list=c_script_create_tree.r)
indices_4 = ListIndices(list=merge_2)
list_length_5 = ListLength(List=c_script_create_tree.r)
split_list = SplitList(List=indices_4, Index=list_length_5)  # -> ListA, ListB
interconnection_indices = Data(split_list.ListA)

all_connections = Panel(split_list.ListA)
all_connections_2 = Panel(merge_2)
interconnection_logic_9 = Panel(indices_3)
flatten_tree_6 = FlattenTree(Tree=lab_names_2, Path="{0}")
lab_2 = Panel(flatten_tree_6)

overall_connectivity = Data(merge_2)
connectivity = Data(overall_connectivity)

# ----
# Outer ring
number_slider_2 = Slider(17, range=0..100)
number_slider_3 = Slider(0.25, range=0..1)
multiplication_2 = Multiplication(A=number_slider_2, B=number_slider_3)
polygon = Polygon(Plane=PlaneXY(0, 0, 0), Radius=number_slider_2, Segments="6", FilletRadius=multiplication_2)  # -> Polygon, Length

# ----
# Atrium
number_slider_4 = Slider(4, range=0..100)
multiplication_3 = Multiplication(A=number_slider_4, B=number_slider_3)
polygon_2 = Polygon(Plane=PlaneXY(0, 0, 0), Radius=number_slider_4, Segments="6", FilletRadius=multiplication_3)  # -> Polygon, Length

areas_4 = Data(flatten(duplicate_data))
lab_area_5 = Panel(areas_4)

initial_room_names = Data(lab_2)
initial_areas = Data(lab_area_5)

# ----
# Area multiplier
panel_7 = Panel(number_slider)
multiplication_4 = Multiplication(A=initial_areas, B=panel_7)

number_slider_5 = Slider(32, range=0..100)
merge_3 = Merge(Data1=polygon.Polygon, Data2=polygon_2.Polygon)
areas_5 = Data(multiplication_4)
group = Group(Objects=merge_3)

# ----
# Calculate volume
height_of_the_room_2 = Panel(height_of_the_room)
multiplication_5 = Multiplication(A=areas_5, B=height_of_the_room_2)
volumes = Data(multiplication_5)

scale_nu = ScaleNU(Geometry=group, Plane=PlaneXY(0, 0, 0), ScaleX=Slider(2.906, range=0.75..3), ScaleY=1, ScaleZ=1)  # -> Geometry, Transform
function_indices_initial_function_branch = Data(function_indices)  # "Function indices INITIAL FUNCTION BRANCHES"
panel_8 = Panel(areas_5)
list_length_6 = ListLength(List=flatten(indices_on_branches))

# ----
# Andrew hexagon
# SHAPE
hospital = Curve(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)
initial_curve = Curve(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)
lab_3 = Curve(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)
merge_4 = Merge(Data1=initial_curve, Data2=lab_3, Data3=hospital)
group_2 = Group(Objects=merge_4)
_2d_geo = Geometry(group_2)
bounding_box = BoundingBox(Content=_2d_geo, Plane=PlaneXY(0, 0, 0))  # -> Box, Box_2
area = Area(Geometry=bounding_box.Box)  # -> Area, Centroid
number_slider_6 = Slider(0.5, range=0.5..2.5)
rotate = Rotate(Geometry=_2d_geo, Angle=degrees("90"), Plane=area.Centroid)  # -> Geometry, Transform
bounding_box_2 = BoundingBox(Content=rotate.Geometry, Plane=PlaneXY(0, 0, 0))  # -> Box, Box_2
area_2 = Area(Geometry=bounding_box_2.Box)  # -> Area, Centroid
floor_height = Panel("5")
scale_nu_2 = ScaleNU(Geometry=rotate.Geometry, Plane=area_2.Centroid, ScaleX=number_slider_6, ScaleY=Slider(0.3378, range=0.1..1.2), ScaleZ=1)  # -> Geometry, Transform
multiplication_6 = Multiplication(A=Slider(4, range=1..5), B=floor_height)
unit_z = UnitZ(Factor=multiplication_6)
ungroup = Ungroup(Group=scale_nu_2.Geometry)
extrude = Extrude(Base=ungroup, Direction=unit_z)
cap_holes = CapHoles(Brep=extrude)
list_item_6 = ListItem(List=cap_holes, Index=0, Wrap=True)  # -> flatten(Item), flatten(Item1), flatten(Item2)
quad_remesh = QuadRemesh(Mesh=cap_holes, Settings={aqc=True, as=50, dhe=True, gci=0, null=False, pme=0, sa=0, tqc=2000})
merge_5 = Merge(Data1=list_item_6.Item1, Data2=list_item_6.Item2)
boundary_divided = Data(merge_5)

# ----
# Get the RADIUS
expression = Expression(x=volumes, Expression="pow(((3*x)/(4*pi)),(1/3))")
expression_2 = Expression(x=areas_5, Expression="sqrt(x / pi)")
ghpython_script_4 = GhPythonScript(x=volumes)  # -> out, a
# ---------- ghpython_script_4: Python ----------
__author__ = "solty"
__version__ = "2021.02.03"

import rhinoscriptsyntax as rs
import math

pi = math.pi
B = 1/3
C = (3*x)/(4*pi)

a = pow(C,B)
# ---------- end ghpython_script_4 ----------
panel_9 = Panel(expression_2)
radius = Panel(ghpython_script_4.a)
radius_2 = Panel(expression)
graft = GraftTree(Tree=panel_9, IncludeEmptyLists=True, IncludeNullItems=True)
room_radius = Panel(graft)
item = ListItem(List=panel_9, Index=connectivity, Wrap=True)
addition = Addition(A=graft, B=item)
room_connection_length = Panel(addition)

# ----
# Initial balls position
point_lab = Point(Point(0.06367439382, -0.1472277506, 0))
rectangle = Rectangle(Plane=point_lab, XSize="-15 to 15", YSize="-15 to 15", Radius=0)  # -> Rectangle, Length
pop2d = Populate2D(Region=rectangle.Rectangle, Count=list_length_6, Seed=1)
graft_2 = GraftTree(Tree=flatten(pop2d), IncludeEmptyLists=True, IncludeNullItems=True)  # -> simplify(Tree)

# ----
# pick lift for LAB
set_communication = Panel("""0
7
15
20""")
data = Data(function_indices_initial_function_branch)
tree_statistics_4 = TreeStatistics(Tree=data)  # -> Paths, Length, Count
list_item_7 = ListItem(List=tree_statistics_4.Paths, Index=set_communication, Wrap=True)
tree_branch_3 = TreeBranch(Tree=data, Path=list_item_7, MaintainPaths=True)
flatten_tree_7 = FlattenTree(Tree=tree_branch_3, Path="{0}")

graft_3 = GraftTree(Tree=initial_room_names, IncludeEmptyLists=True, IncludeNullItems=True)  # -> simplify(Tree)
room_name = Panel(graft_3)
room_connection_lines = Panel(connectivity)
scale_nu_3 = ScaleNU(
    Geometry=rotate.Geometry,
    Plane=area_2.Centroid,
    ScaleX=Slider(0.9861, range=0.5..2.5),
    ScaleY=Slider(0.3667, range=0.1..1.2),
    ScaleZ=1)  # -> Geometry, Transform

# ----
# Initial balls position
# Define initial locations for certain funcitons
scale = Scale(Geometry=list_item_6.Item, Center=area_2.Centroid, Factor=number_slider_6)  # -> Geometry, Transform
extrude_2 = Extrude(Base=scale.Geometry, Direction=unit_z)
# DEFINE COLOR PALLETTE
# Text tags
# Create connection lines
# Floor planes
# parametrize initial positions
cap_holes_2 = CapHoles(Brep=extrude_2)  # disabled

panel_10 = Panel(factor_to_alter_distance_between_functio)

# ----
# Alter interconnection length
interconnection_indices_2 = Data(interconnection_indices)
list_item_8 = ListItem(List=addition, Index=interconnection_indices_2, Wrap=True)
multiplication_7 = Multiplication(A=list_item_8, B=panel_10)
replace_items = ReplaceItems(List=addition, Item=multiplication_7, Indices=interconnection_indices_2, Wrap=False)
trim_tree = TrimTree(Tree=replace_items, Depth="1")

# ----
# Length multiplier
overall_length_multiplier = Panel(factor_to_alter_all_distances)
multiplication_8 = Multiplication(A=trim_tree, B=overall_length_multiplier)

data_2 = Data(list_item_6.Item1)
line_lengths = Data(multiplication_8)
constraint_strength = Panel("100")
plane_point_collide_constraint = Panel("1000")
pull_and_collide_strength = Panel("150")

# ----
# Define initial locations for certain funcitons
set_communication_2 = Panel(flatten_tree_7)
concatenate_3 = Concatenate(Fragment_A="{", Fragment_B=set_communication_2, A="}")
split_tree = SplitTree(Data=graft_2, Masks=flatten(concatenate_3))  # -> Positive, Negative

# ----
# Move here comm V LAB
list_length_7 = ListLength(List=flatten(split_tree.Positive))
point = Point(Point(-7.755992704, 0.1361355647, 0))
point_2 = Point(Point(-5.152722012, 0.1361355647, 0))
series_4 = Series(Start=0, Step=1, Count=list_length_7)
unit_z_2 = UnitZ(Factor=series_4)
move = Move(Geometry=point, Motion=unit_z_2)  # -> Geometry, Transform
graft_tree_2 = GraftTree(Tree=move.Geometry, IncludeEmptyLists=True, IncludeNullItems=True)
match_tree = MatchTree(Tree=graft_tree_2, Guide=split_tree.Positive)
vector_2pt = Vector2Pt(PointA=split_tree.Positive, PointB=match_tree, Unitize=False)  # -> Vector, Length

move_2 = Move(Geometry=split_tree.Positive, Motion=vector_2pt.Vector)  # -> Geometry, Transform
merge_6 = Merge(Data1=move_2.Geometry, Data2=split_tree.Negative)

# ----
# Create connection lines
grafted_points = Data(merge_6)
item_2 = ListItem(List=flatten(grafted_points), Index=connectivity, Wrap=True)
ln = Line(StartPoint=grafted_points, EndPoint=item_2)

room_centers = Point(flatten(grafted_points))
connection_lines = Data(ln)
line_lengths_2 = Data(multiplication_8)
room_radius_2 = Data(panel_9)
boundary = Data(list_item_6.Item)

# ----
# Assign floors to rooms
function_indices_3 = Panel(function_indices)
initial_room_names_2 = Panel(lab)
room_names = Panel(initial_room_names)
room_center_points = Panel(room_centers)
_0_floor_2 = Panel(_0_floor)
_1_floor_2 = Panel(_1_floor)
_2_floor_2 = Panel(_2_floor)
_3_floor_2 = Panel(_3_floor)
entwine_2 = Entwine(Branch00=_0_floor_2, Branch01=_1_floor_2, Branch02=_2_floor_2, Branch03=_3_floor_2, FlattenInputs=True)

dupln = RemoveDuplicateLines(Lines=flatten(ln), Tolerance=0.01)
list_length_8 = ListLength(List=flatten(connection_lines))
list_length_9 = ListLength(List=flatten(dupln))
ghpython_script_5 = GhPythonScript(x=list_length_8, y=list_length_9)  # -> out, a
# ---------- ghpython_script_5: Python ----------
__author__ = "solty"
__version__ = "2021.02.03"

import rhinoscriptsyntax

if x == y:
    a = 'No overlap'
else:
    a= 'Lines overlapping'
# ---------- end ghpython_script_5 ----------
check_if_there_are_duplicate_lines = Panel(ghpython_script_5.a)

# ----
# Area per floor
data_3 = Data(duplicate_data)
tree_statistics_5 = TreeStatistics(Tree=data_3)  # -> Paths, Length, Count
floor_distribiution = Data(entwine_2)
list_item_9 = ListItem(List=tree_statistics_5.Paths, Index=floor_distribiution, Wrap=True)
explode_tree = ExplodeTree(Data=list_item_9)  # -> Branch0, Branch1, Branch2, Branch3
panel_11 = Panel(list_item_9)
tree_branch_4 = TreeBranch(Tree=data_3, Path=explode_tree.Branch0, MaintainPaths=False)
tree_branch_5 = TreeBranch(Tree=data_3, Path=explode_tree.Branch1, MaintainPaths=False)
tree_branch_6 = TreeBranch(Tree=data_3, Path=explode_tree.Branch2, MaintainPaths=False)
tree_branch_7 = TreeBranch(Tree=data_3, Path=explode_tree.Branch3, MaintainPaths=False)
entwine_3 = Entwine(Branch00=tree_branch_4, Branch01=tree_branch_5, Branch02=tree_branch_6, Branch03=tree_branch_7, FlattenInputs=True)
mass_addition = MassAddition(Input=entwine_3)  # -> Result, PartialResults
area_per = Panel(mass_addition.Result)

# ----
# Assign indices to floor
data_4 = Data(function_indices_3)
tree_statistics_6 = TreeStatistics(Tree=data_4)  # -> Paths, Length, Count
floor_distribiution_2 = Data(entwine_2)
list_item_10 = ListItem(List=tree_statistics_6.Paths, Index=floor_distribiution_2, Wrap=True)
explode_tree_2 = ExplodeTree(Data=list_item_10)  # -> Branch0, Branch1, Branch2, Branch3
panel_12 = Panel(list_item_10)
tree_branch_8 = TreeBranch(Tree=data_4, Path=explode_tree_2.Branch0, MaintainPaths=False)
tree_branch_9 = TreeBranch(Tree=data_4, Path=explode_tree_2.Branch1, MaintainPaths=False)
tree_branch_10 = TreeBranch(Tree=data_4, Path=explode_tree_2.Branch2, MaintainPaths=False)
tree_branch_11 = TreeBranch(Tree=data_4, Path=explode_tree_2.Branch3, MaintainPaths=False)
entwine_4 = Entwine(Branch00=tree_branch_8, Branch01=tree_branch_9, Branch02=tree_branch_10, Branch03=tree_branch_11, FlattenInputs=True)

# ----
# Assign floors to rooms
centers = Data(room_centers)
unflatten_tree_3 = UnflattenTree(Tree=centers, Guide=function_indices_3)
data_5 = Data(unflatten_tree_3)
tree_statistics_7 = TreeStatistics(Tree=data_5)  # -> Paths, Length, Count
floor_distribiution_3 = Data(entwine_2)
list_item_11 = ListItem(List=tree_statistics_7.Paths, Index=floor_distribiution_3, Wrap=True)
explode_tree_3 = ExplodeTree(Data=list_item_11)  # -> Branch0, Branch1, Branch2, Branch3
panel_13 = Panel(list_item_11)
tree_branch_12 = TreeBranch(Tree=data_5, Path=explode_tree_3.Branch0, MaintainPaths=False)
tree_branch_13 = TreeBranch(Tree=data_5, Path=explode_tree_3.Branch1, MaintainPaths=False)
tree_branch_14 = TreeBranch(Tree=data_5, Path=explode_tree_3.Branch2, MaintainPaths=False)
tree_branch_15 = TreeBranch(Tree=data_5, Path=explode_tree_3.Branch3, MaintainPaths=False)
entwine_5 = Entwine(Branch00=tree_branch_12, Branch01=tree_branch_13, Branch02=tree_branch_14, Branch03=tree_branch_15, FlattenInputs=True)

bounding_box_3 = BoundingBox(Content=boundary, Plane=PlaneXY(0, 0, 0))  # -> Box, Box_2
deconstruct_brep = DeconstructBrep(Brep=bounding_box_3.Box)  # -> Faces, Edges, Vertices
merge_7 = Merge(Data1=Slider(0, range=0..11), Data2=Slider(1, range=0..11), Data3=Slider(10, range=0..11))

# ---- group: anchor points
merge_8 = Merge(Data1=flatten(set_communication_2))  # -> flatten(Result)
set_communication_3 = Panel(merge_8)
boolean_toggle = BooleanToggle(True)
list_item_12 = ListItem(List=flatten(room_centers), Index=set_communication_3, Wrap=True)
panel_14 = Panel(plane_point_collide_constraint)
anchorxyz = AnchorXYZ(Point=list_item_12, X=boolean_toggle, Y=boolean_toggle, Z=False, Strength=panel_14)
path_mapper = PathMapper(anchorxyz, source="{A}", target="{2}")

# ----
# Floor planes
number_slider_7 = Slider(10, range=0..11)
list_item_13 = ListItem(List=deconstruct_brep.Edges, Index=number_slider_7, Wrap=True)
divide_curve = DivideCurve(Curve=list_item_13, Count=Slider(5, range=0..10), Kinks=False)  # -> Points, Tangents, Parameters
panel_15 = Panel("""-1
0""")
cull_index = CullIndex(List=divide_curve.Points, Indices=panel_15, Wrap=True)
# connection lines
# Dimensions
# Wireframe
construct_plane = ConstructPlane(Origin=cull_index, XAxis=Vector(1, 0, 0), YAxis=Vector(0, 1, 0))

bounding_box_4 = BoundingBox(Content=boundary, Plane=PlaneXY(0, 0, 0))  # -> Box, Box_2
volume = Volume(Geometry=bounding_box_4.Box)  # -> Volume, Centroid
B = Bomb(Location=volume.Centroid, Points=room_centers, DetonationTime=0, Strength="600", Reset=Button())

# ---- group: Plane partitions
plane = Plane(graft(construct_plane))
match_tree_2 = MatchTree(Tree=plane, Guide=entwine_5)
onplane = OnPlane(Points=entwine_5, Plane=match_tree_2, Strength="1500")

# ----
spc = SolidPointCollide(Points=room_centers, Solid=boundary, Interior=Toggle(True), Unidirectional=True, Strength="500")

panel_16 = Panel(pull_and_collide_strength)
length_line = LengthLine(Line=connection_lines, Length=line_lengths_2, Strength=panel_16)

panel_17 = Panel(pull_and_collide_strength)
sc = SphereCollide(Points=room_centers, Radius=room_radius_2, Strength=panel_17)

merge_9 = Merge(Data1=B, Data2=length_line, Data3=sc, Data4=spc, Data5=onplane, Data6=path_mapper)  # -> flatten(Result)
merge_10 = Merge(Data1=B, Data2=length_line, Data3=sc, Data4=spc, Data5=onplane, Data6=path_mapper)  # -> flatten(Result)
zombiesolver = ZombieSolver(GoalObjects=merge_9, Threshold="1e-20", Tolerance=0.01, MaxIterations=50000)  # -> I, V, O
iteration_counter = Panel(zombiesolver.I)
pt = Point(zombiesolver.V)
dist = Distance(PointA=volume.Centroid, PointB=pt)
line = Line(zombiesolver.O)
equals = Equality(FirstNumber=dist, SecondNumber="0")  # -> Equality, Inequality
clean = CleanTree(RemoveNulls=True, RemoveInvalid=Toggle(True), RemoveEmpty=False, Tree=line)
cull = CullPattern(List=pt, CullPattern=invert(equals.Equality))
clean_2 = CleanTree(RemoveNulls=True, RemoveInvalid=True, RemoveEmpty=False, Tree=cull)
list_length_10 = ListLength(List=room_centers)
split_list_2 = SplitList(List=clean_2, Index=list_length_10)  # -> ListA, ListB
unflatten_tree_4 = UnflattenTree(Tree=split_list_2.ListA, Guide=lab_names_2)
panel_18 = Panel(split_list_2.ListB)
mesh_sphere_ex = MeshSphereEx(Base=split_list_2.ListA, Radius=room_radius_2, Count=5)
unflatten_tree_5 = UnflattenTree(Tree=split_list_2.ListA, Guide=lab_names_2)
list_item_14 = ListItem(List=unflatten_tree_5, Index=0, Wrap=True)
unflatten_tree_6 = UnflattenTree(Tree=mesh_sphere_ex, Guide=lab_names_2)
mesh_spheres = Data(unflatten_tree_6)

# ---- group: RH_OUT:mesh
# Elefront organized baking
# Joined function outlines
# Elefront organized baking
# Joined function
# Elefront organized baking
# divided function
# Corridors layers
# Assign outlines
# Sort values from floors to divided functions
# Assign geometry to bake
# DEFINE COLOR PALLETTE
# Assign names to rooms
# Divided function layers
# Joined function layers
# Joined function region layers
# Testing of the unioning
# Corridor floors massings
# Lift per floor, per lab/hosp
# Floor heights
# Delete middle curves
# Highlight comm
# Put function on branches
# Delete curves from the V comm boundaries
# Delete curves from the V comm boundaries
# Quick python loop to search for the values
# Quick python loop to search for the values
# Delete curves smalle than
# Check if work
# Sort verts by dist. and pick closest one
# Do it twice to ignore moment when
# there is exactly 1 line seperating v comms
# Do it twice to ignore moment when
# there is exactly 1 line seperating v comms
# Connection between functions per lab\hospital
# Select communication
# Dup data to match the number of points to check
mesh_spheres_2 = Mesh(mesh_spheres)

# ==== cluster ListIndices: Creates list indices
list = ClusterInput()
list_length = ListLength(List=list)
series = Series(Start="0", Step="1", Count=list_length)
trim_tree = TrimTree(Tree=series, Depth="1")
indices = Data(trim_tree)
indices_2 = ClusterOutput(indices)
