# Grasshopper definition test.gh (Grasshopper 1.0.7)

x_position = Slider(71, range=1..150)
y_position = Slider(60, range=1..210)
unit_z = UnitZ(Factor=1)
mesh = Mesh(<mesh referenced from the Rhino model>)
x_position_2 = GetNumber(x_position, AtLeast=1, AtMost=2147483647, Maximum=1.797693135e+308, Minimum=-1.797693135e+308)
y_position_2 = GetNumber(y_position, AtLeast=1, AtMost=2147483647, Maximum=1.797693135e+308, Minimum=-1.797693135e+308)
contour = Contour(Shape=mesh, Point=Point(0, 0, 0), Direction=unit_z, Distance=Slider(0.984, range=0.1..4))  # -> flatten(Contours)
construct_point = ConstructPoint(XCoordinate=x_position_2, YCoordinate=y_position_2, ZCoordinate=0)
unit_z_2 = UnitZ(Factor=1)
project_point = ProjectPoint(Point=construct_point, Direction=unit_z_2, Geometry=mesh)  # -> Point, Index
fillet = Fillet(Curve=contour, Radius=Slider(12.8, range=0.1..20))
sphere = Sphere(Base=project_point.Point, Radius=Slider(13, range=1..40))
mesh_sphere_ex = MeshSphereEx(Base=project_point.Point, Radius=10, Count=5)
curve = Curve(fillet)
solid_union = SolidUnion(Breps=sphere)
panel = Panel("""TRUE
FALSE
FALSE""")
cull_pattern = CullPattern(List=curve, CullPattern=invert(panel))
cull_pattern_2 = CullPattern(List=curve, CullPattern=panel)
dash_pattern = DashPattern(Curve=cull_pattern_2, Pattern=Slider(1.9, range=0.1..5))  # -> Dashes, Gaps
curve_2 = Curve(cull_pattern)
start_hour = Slider(1, range=1..23)
end_hour = Slider(23, range=1..23)
day = Slider(1, range=1..30)
month = Slider(1, range=1..12)

panel_2 = Panel("http://climate.onebuilding.org/WMO_Region_4_North_and_Central_America/USA_United_States_of_America/WI_Wisconsin/USA_WI_Madison-Dane.County.Rgnl.AP-Truax.Field.726410_TMY3.zip")
downloadepw = LBDownloadWeather(weather_URL=panel_2)  # -> epw_file, stat_file, ddy_file; plug-in component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
importloc = LBImportLocation(epw_file=downloadepw.epw_file)  # -> location; plug-in component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

month_2 = GetNumber(month, AtLeast=1, AtMost=2147483647, Maximum=1.797693135e+308, Minimum=-1.797693135e+308)
start_hour_2 = GetNumber(start_hour, AtLeast=1, AtMost=2147483647, Maximum=1.797693135e+308, Minimum=-1.797693135e+308)
legend = GetNumber(Slider(25, range=0..25), AtLeast=1, AtMost=2147483647, Maximum=1.797693135e+308, Minimum=-1.797693135e+308)
day_2 = GetNumber(day, AtLeast=1, AtMost=2147483647, Maximum=1.797693135e+308, Minimum=-1.797693135e+308)
end_hour_2 = GetNumber(end_hour, AtLeast=1, AtMost=2147483647, Maximum=1.797693135e+308, Minimum=-1.797693135e+308)
analysisperiod = LBAnalysisPeriod(start_month=month_2, start_day=day_2, start_hour=start_hour_2, end_month=month_2, end_day=day_2, end_hour=end_hour_2)  # -> period, hoys, dates; plug-in component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
colrange = LBColorRange(index=legend)  # -> colors; plug-in component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

sunpath = LBSunPath(north="20", location=importloc, hoys=analysisperiod.hoys, center_pt=project_point.Point, scale=1)  # -> report, vectors, altitudes, azimuths, hoys, sun_pts, analemma, daily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; plug-in component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

legendpar = LBLegendParameters(colors=colrange)  # -> leg_par; plug-in component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

# ---- group: Run Me!
toggle = BooleanToggle(True)

# ----
directsunhours = LBDirectSunHours(
    vectors=flatten(sunpath.vectors),
    geometry=flatten(solid_union),
    context=flatten(mesh),
    grid_size="2",
    offset_dist="0.1",
    legend_par=legendpar,
    run=toggle)  # -> report, points, results, mesh, legend, title, int_mtx; plug-in component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

mesh_colours = MeshColours(Mesh=mesh, Colours=ColourSwatch(SwatchColor=RGB(201, 201, 201)))

# ---- group: RH_OUT:ground
groundmesh = Mesh(mesh_colours)

# ---- group: RH_OUT:curve
curve_3 = Curve([dash_pattern.Dashes, curve_2])

# ---- group: RH_OUT:mesh
mesh_2 = Mesh(directsunhours.mesh)
