# Grasshopper definition twisted_tower.gh (Grasshopper 1.0.7)

cluster = Cluster()
rotation = Slider(40, range=0..180)
floor_thck = Slider(0.3, range=0.1..1.1)
lenght = Slider(70, range=10..100)
width = Slider(45, range=10..100)
f2f = Slider(3.6, range=3..7)
floors = Slider(27, range=1..30)
legend = Slider(11, range=0..25)
start_hour = Slider(1, range=1..23)
month = Slider(1, range=1..12)
end_hour = Slider(23, range=1..23)
day = Slider(1, range=1..30)

# ---- group: RH_IN:run_analysis
boolean_toggle = BooleanToggle(False)

# ----
facade_position = GetNumber(Slider(0.8, range=0.8..1), AtLeast=1, AtMost=2147483647, Maximum=1.797693135e+308, Minimum=-1.797693135e+308)
month_2 = GetNumber(month, AtLeast=1, AtMost=2147483647, Maximum=1.797693135e+308, Minimum=-1.797693135e+308)
length = GetNumber(lenght, AtLeast=1, AtMost=2147483647, Maximum=1.797693135e+308, Minimum=-1.797693135e+308)
floor_heigth = GetNumber(f2f, AtLeast=1, AtMost=2147483647, Maximum=1.797693135e+308, Minimum=-1.797693135e+308)
day_2 = GetNumber(day, AtLeast=1, AtMost=2147483647, Maximum=1.797693135e+308, Minimum=-1.797693135e+308)
floors_2 = GetNumber(floors, AtLeast=1, AtMost=2147483647, Maximum=1.797693135e+308, Minimum=-1.797693135e+308)
start_hour_2 = GetNumber(start_hour, AtLeast=1, AtMost=2147483647, Maximum=1.797693135e+308, Minimum=-1.797693135e+308)
rotation_2 = GetNumber(rotation, AtLeast=1, AtMost=2147483647, Maximum=1.797693135e+308, Minimum=-1.797693135e+308)
legend_2 = GetNumber(legend, AtLeast=1, AtMost=2147483647, Maximum=1.797693135e+308, Minimum=-1.797693135e+308)
width_2 = GetNumber(width, AtLeast=1, AtMost=2147483647, Maximum=1.797693135e+308, Minimum=-1.797693135e+308)
end_hour_2 = GetNumber(end_hour, AtLeast=1, AtMost=2147483647, Maximum=1.797693135e+308, Minimum=-1.797693135e+308)
curve = Curve(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)
negative = Negative(Value=length)
negative_2 = Negative(Value=width_2)
construct_domain = ConstructDomain(DomainStart=expr("x/2", negative), DomainEnd=expr("x/2", length))
area = Area(Geometry=curve)  # -> Area, Centroid
construct_domain_2 = ConstructDomain(DomainStart=expr("x/2", negative_2), DomainEnd=expr("x/2", width_2))
rectangle = Rectangle(Plane=area.Centroid, XSize=construct_domain, YSize=construct_domain_2, Radius=0)  # -> Rectangle, Length
area_2 = Area(Geometry=rectangle.Rectangle)  # -> Area, Centroid
series = Series(Start=0, Step=floor_heigth, Count=floors_2)
scale_nu = ScaleNU(Geometry=rectangle.Rectangle, Plane=area_2.Centroid, ScaleX=facade_position, ScaleY=facade_position, ScaleZ=1)  # -> Geometry, Transform

Z = UnitZ(Factor=floor_thck)
neg = Negative(Value=Z)
extr = Extrude(Base=rectangle.Rectangle, Direction=neg)
cap = CapHoles(Brep=extr)

Z_2 = UnitZ(Factor=floor_thck)
neg_2 = Negative(Value=Z_2)
extr_2 = Extrude(Base=curve, Direction=neg_2)
subtraction = Subtraction(A=floor_heigth, B=floor_thck)
settings_custom = SettingsCustom(
    StitchSeams=invert(True),
    SimplePlanes=False,
    Refine=invert(True),
    MinCount=Slider(40, range=1..500),
    MaxCount=400,
    AspectRatio=20,
    MaxDistance=0,
    MaxAngle=20,
    MinEdge=0,
    MaxEdge=0)
settings_custom_2 = SettingsCustom(
    StitchSeams=invert(True),
    SimplePlanes=False,
    Refine=invert(True),
    MinCount=Slider(500, range=1..500),
    MaxCount=400,
    AspectRatio=20,
    MaxDistance=0,
    MaxAngle=20,
    MinEdge=0,
    MaxEdge=0)
cap_2 = CapHoles(Brep=extr_2)
Z_3 = UnitZ(Factor=subtraction)
cull_index = CullIndex(List=series, Indices=-1, Wrap=True)
mesh = MeshBrep(Brep=cap, Settings=settings_custom)
mesh_2 = MeshBrep(Brep=cap_2, Settings=settings_custom_2)
Z_4 = UnitZ(Factor=series)
extr_3 = Extrude(Base=scale_nu.Geometry, Direction=Z_3)
Z_5 = UnitZ(Factor=cull_index)
move = Move(Geometry=mesh, Motion=Z_4)  # -> Geometry, Transform
move_2 = Move(Geometry=mesh_2, Motion=neg_2)  # -> Geometry, Transform
mesh_3 = MeshBrep(Brep=extr_3, Settings=settings_custom)
area_3 = Area(Geometry=move.Geometry)  # -> Area, Centroid
move_3 = Move(Geometry=mesh_3, Motion=Z_5)  # -> Geometry, Transform
lng = ListLength(List=move.Geometry)  # -> expr("X-1", Length)
dom = ConstructDomain(DomainStart=0, DomainEnd=rotation_2)
area_4 = Area(Geometry=move_3.Geometry)  # -> Area, Centroid

panel = Panel("http://climate.onebuilding.org/WMO_Region_1_Africa/ZAF_South_Africa/GT_Gauteng/ZAF_GT_Johannesburg.Botanical.Gardens.683610_TMYx.zip")
downloadepw = LBDownloadWeather(weather_URL=panel)  # -> epw_file, stat_file, ddy_file; plug-in component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
importloc = LBImportLocation(epw_file=downloadepw.epw_file)  # -> location; plug-in component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

range = Range(Domain=dom, Steps=lng)
lng_2 = ListLength(List=move_3.Geometry)  # -> expr("X-1", Length)
dom_2 = ConstructDomain(DomainStart=0, DomainEnd=rotation_2)
rotate = Rotate(Geometry=move.Geometry, Angle=degrees(range), Plane=area_3.Centroid)  # -> Geometry, Transform
range_2 = Range(Domain=dom_2, Steps=lng_2)
rotate_2 = Rotate(Geometry=move_3.Geometry, Angle=degrees(range_2), Plane=area_4.Centroid)  # -> Geometry, Transform
mesh_colours = MeshColours(Mesh=move_2.Geometry, Colours=ColourSwatch(SwatchColor=RGB(161, 178, 194)))
mesh_colours_2 = MeshColours(Mesh=rotate_2.Geometry, Colours=ColourSwatch(SwatchColor=RGBA(110, 154, 194, 94)))
analysisperiod = LBAnalysisPeriod(start_month=month_2, start_day=day_2, start_hour=start_hour_2, end_month=month_2, end_day=day_2, end_hour=end_hour_2)  # -> period, hoys, dates; plug-in component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
colrange = LBColorRange(index=legend_2)  # -> colors; plug-in component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

sunpath = LBSunPath(north="20", location=importloc, hoys=analysisperiod.hoys, center_pt=area.Centroid, scale=1.2, daily=Toggle(True))  # -> report, vectors, altitudes, azimuths, hoys, sun_pts, analemma, daily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; plug-in component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

legendpar = LBLegendParameters(colors=colrange)  # -> leg_par; plug-in component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
flip_mesh = FlipMesh(Mesh=rotate_2.Geometry, VertexNormals=True, FaceNormals=True, FaceOrientation=True)
flip_mesh_2 = FlipMesh(Mesh=rotate.Geometry, VertexNormals=True, FaceNormals=True, FaceOrientation=True)
curve_2 = Curve(sunpath.daily)
curve_3 = Curve(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)
mesh_4 = Mesh([rotate.Geometry, mesh_colours, mesh_colours_2])

directsunhours = LBDirectSunHours(
    vectors=flatten(sunpath.vectors),
    geometry=flatten([flip_mesh, move_2.Geometry]),
    context=flatten(flip_mesh_2),
    grid_size=Slider(4, range=1..5),
    offset_dist=".1",
    legend_par=legendpar,
    run=boolean_toggle)  # -> report, points, results, mesh, legend, title, int_mtx; plug-in component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

mesh_sphere = MeshSphere(Base=sunpath.sun_pts, Radius=5, UCount=5, VCount=5)
list_item = ListItem(List=directsunhours.legend, Index=0, Wrap=True)
mesh_5 = Mesh(list_item)
mesh_colours_3 = MeshColours(Mesh=mesh_sphere, Colours=ColourSwatch(SwatchColor=RGB(185, 186, 112)))
mesh_6 = Mesh([directsunhours.mesh, rotate.Geometry, mesh_5, mesh_colours_3])
stream_filter = StreamFilter(Gate=boolean_toggle, Stream0=mesh_4, Stream1=mesh_6)  # -> flatten(Stream)
panel_2 = Panel("""0
1""")
deconstruct_mesh = DeconstructMesh(Mesh=mesh_5)  # -> Vertices, Faces, Colours, Normals
cull_index_2 = CullIndex(List=directsunhours.legend, Indices=panel_2, Wrap=True)
list_item_2 = ListItem(List=deconstruct_mesh.Vertices, Index=0, Wrap=True)
list_length = ListLength(List=cull_index_2)
unit_x = UnitX(Factor=Slider(9.6, range=0.1..10))
series_2 = Series(Start=0, Step=Slider(14.5, range=0.1..20), Count=list_length)

# ---- group: RH_OUT:mesh
mesh_7 = Mesh(stream_filter)

# ----
move_4 = Move(Geometry=list_item_2, Motion=unit_x)  # -> Geometry, Transform
concatenate = Concatenate(FragmentA=cull_index_2, FragmentB=" HRS")
unit_y = UnitY(Factor=series_2)
move_5 = Move(Geometry=move_4.Geometry, Motion=unit_y)  # -> Geometry, Transform
unit_y_2 = UnitY(Factor=Slider(7.9, range=0.1..10))
move_6 = Move(Geometry=move_5.Geometry, Motion=unit_y_2)  # -> Geometry, Transform
bool = Boolean(invert(True))
c_script = CSharpScript(face="Verdana", bold=bool, size=Slider(2.181, range=0..11), content=concatenate, pl=move_6.Geometry)  # -> out, A; inputs face: String, bold: Boolean, italics: Boolean, size: Double, content: String, pl: Plane
# ---------- c_script: C# usings ----------
using System.IO;
using System.Linq;
using System.Data;
using System.Drawing;
using System.Reflection;
using System.Windows.Forms;
using System.Xml;
using System.Xml.Linq;
using System.Runtime.InteropServices;

using Rhino.DocObjects;
using Rhino.Collections;
using GH_IO;
using GH_IO.Serialization;
# ---------- c_script: C# ----------
    if(size == 0)
      size = 1;

    if(!string.IsNullOrEmpty(face) && size > 0 && !string.IsNullOrEmpty(content) &&
      pl.IsValid)
    {
      using (var doc = Rhino.RhinoDoc.CreateHeadless(null))
      {
        var te = doc.Objects.AddText(content, pl, size, face, bold, italics);
        var txt = doc.Objects.Find(te) as Rhino.DocObjects.TextObject;

        if(txt != null)
        {
          var tt = txt.Geometry as Rhino.Geometry.TextEntity;
          A = tt.Explode();
        }
      }
    }
# ---------- end c_script ----------
curve_4 = Curve([c_script.A, curve_2])
stream_filter_2 = StreamFilter(Gate=boolean_toggle, Stream0=curve_3, Stream1=curve_4)  # -> flatten(Stream)

# ---- group: RH_OUT:curves
curve_5 = Curve(stream_filter_2)

# ==== cluster Cluster
